vi "Function.gvi"   [LabVIEW NXG 5.0.0]
inputs:
  "Value": i32[] = [1000, 2000, 3000]
  "Listbox": i32[]
panel indicators:
  "Sum": i32
  "0index": f64
  "Output": i32[]
  "1_1": f64
  "Output_4": i32[]
  "1_0": f64
  "1index": f64
  "2index": f64
  "3index": f64
  "Output_index": f64[]
diagram:
  while {
    Property Node(instance in=reference to "Listbox") -> ("Value"=w1)
    for {
      w2 = each element of w1
      Array Index(array=$Value) -> (out0[0]=w5, out1[1]=w6, out2[2]=w7, out3[3]=w8)
      Array Index(array=$Value) -> (out0[w2]=w9)
      append w9 to w3
      append w2 to w4
    }
    Array Index(array=w3) -> (out0[0]=w10, out1[1]=w11, out2[2]=w12, out3[3]=w13)
    Is Equal(x=w5, y=w10) -> w14
    Select(s=w14, t=1, f=0) -> w15
    $"0index" <- w15
    Is Equal(x=w6, y=w11) -> w16
    Select(s=w16, t=1, f=0) -> w17
    Is Equal(x=w6, y=w10) -> w18
    Select(s=w18, t=1, f=0) -> w19
    Add(w17, w19) -> w20
    Is Equal(x=w10, y=w7) -> w21
    Select(s=w21, t=1, f=0) -> w22
    Is Equal(x=w11, y=w7) -> w23
    Select(s=w23, t=1, f=0) -> w24
    Is Equal(x=w12, y=w7) -> w25
    Select(s=w25, t=1, f=0) -> w26
    Add(w22, w24, w26) -> w27
    Is Equal(x=w10, y=w8) -> w28
    Select(s=w28, t=1, f=0) -> w29
    Is Equal(x=w11, y=w8) -> w30
    Select(s=w30, t=1, f=0) -> w31
    Is Equal(x=w12, y=w8) -> w32
    Select(s=w32, t=1, f=0) -> w33
    Is Equal(x=w13, y=w8) -> w34
    Select(s=w34, t=1, f=0) -> w35
    Add(w29, w31, w33, w35) -> w36
    Replace Array Subset(inArray=f64[] [], index=_, new=w15, index=_, new=w20, index=_, new=w27, index=_, new=w36) -> w37
    $Output_index <- w37
    $"1_1" <- w17
    $"1index" <- w20
    $"1_0" <- w19
    Add Array Elements(numeric array=w3) -> (sum=w38)
    $Sum <- w38
    $Output <- w3
    $Output_4 <- w4
    $"2index" <- w27
    $"3index" <- w36
    stop if FALSE
  }
