vi "Function_2.gvi"   [LabVIEW NXG 5.0.0]
panel controls:
  "Value": i32[] = [1000, 2000, 3000]
  "Listbox": i32[]
panel indicators:
  "Sum": i32
  "0index": f64
  "Output": i32[]
  "1_1": f64
  "Output_4": i32[]
  "1_0": f64
  "1index": f64
  "2index": f64
  "3index": f64
diagram:
  while {
    w1 = $Value
    Property Node(instance in=reference to "Listbox") -> ("Value"=w2)
    for {
      w3 = each element of w2
      Array Index(array=w1) -> (out0[0]=w6, out1[1]=w7, out2[2]=w8, out3[3]=w9)
      Array Index(array=w1) -> (out0[w3]=w10)
      append w10 to w4
      append w3 to w5
    }
    Array Index(array=w4) -> (out0[0]=w11, out1[1]=w12, out2[2]=w13, out3[3]=w14)
    Is Equal(x=w6, y=w11) -> w15
    Select(s=w15, t=1, f=0) -> w16
    $"0index" <- w16
    Is Equal(x=w7, y=w12) -> w17
    Select(s=w17, t=1, f=0) -> w18
    $"1_1" <- w18
    Is Equal(x=w7, y=w11) -> w19
    Select(s=w19, t=1, f=0) -> w20
    Add(w18, w20) -> w21
    $"1index" <- w21
    $"1_0" <- w20
    Add Array Elements(numeric array=w4) -> (sum=w22)
    $Sum <- w22
    $Output <- w4
    $Output_4 <- w5
    Is Equal(x=w11, y=w8) -> w23
    Select(s=w23, t=1, f=0) -> w24
    Is Equal(x=w12, y=w8) -> w25
    Select(s=w25, t=1, f=0) -> w26
    Is Equal(x=w13, y=w8) -> w27
    Select(s=w27, t=1, f=0) -> w28
    Add(w24, w26, w28) -> w29
    $"2index" <- w29
    Is Equal(x=w11, y=w9) -> w30
    Select(s=w30, t=1, f=0) -> w31
    Is Equal(x=w12, y=w9) -> w32
    Select(s=w32, t=1, f=0) -> w33
    Is Equal(x=w13, y=w9) -> w34
    Select(s=w34, t=1, f=0) -> w35
    Is Equal(x=w14, y=w9) -> w36
    Select(s=w36, t=1, f=0) -> w37
    Add(w31, w33, w35, w37) -> w38
    $"3index" <- w38
    stop if FALSE
  }
