vi "SLC.gvi"   [LabVIEW NXG 5.0.0]
panel controls:
  "PV-Temperature, ºC": f64
  "PV-Intensity, W/m2": f64
  "PV-Panel Tilt Angle, º": f64
  "PV-Angle Of Rotation, º": f64
  "error in_2": error
  "PV-Current, A": f64
  "PV-Voltage, V": f64
  "PV-Load,Ohm": f64
  "Boolean_2": bool
  "PV-Connecting Solar Panels": string
  "PV-Load 1": string
  "PV-Load 2": string
  "PV-Load 3": string
  "PV-Load 4": string
  "PV-Cooling Conditions": string
  "PV-Heating Conditions": string
  "PV-Dimming Conditions": string
  "Do Something <Replace Me>": bool
  "Do Something Else <Replace Me>": bool
  "Exit": bool
  "stop": bool
panel indicators:
  "error out_2": error
  "MV-Connecting Solar Panels": string
  "MV-Cooling Conditions": string
  "MV-Heating Conditions": string
  "MV-Dimming Conditions": string
  "MV-Panel Tilt Angle, º": string
  "MV-Light Source Power, W": string
  "MV-Load 4": string
  "MV-Load 3": string
  "MV-Load 2": string
  "MV-Load 1": string
  "Display <Replace Me>": string
  "API Key": string
  "Server Url": string
  "Connecting Solar Panels": string
  "Cooling Conditions_2": string
  "Round LED": bool
types:
  "UI Data.gtype" = cluster{"Boolean <Replace Me>": bool, "String <Replace Me>": string, "Numeric <Replace Me>": f64}
uses:
  Message Queue::Create All Message Queues.gvi
  Message Queue::Dequeue Message.gvi
  Message Queue::Enqueue Message (Single).gvi
  NI::G Core::Error::Display Error.gvi
  NI::G Core::Error::Build Error Cluster.gvi
  Support::Error Handler - Message Handling Loop.gvi
  Support::Error Handler - Event Handling Loop.gvi
  NI::Skyline::Configuration::Open Configuration API Key.gvi
  NI::Skyline::TagHTTP::Query Tags.gvi
  NI::Skyline::TagHTTP::Open Tag.gvi
  NI::Skyline::TagHTTP::Read Tag (String).gvi
  NI::Skyline::TagHTTP::Close Tag (Single).gvi
  NI::Skyline::Configuration::Close Configuration.gvi
diagram:
  $"API Key" <- "zYUbuW0YNkg1G__lXfJiGVBNWME-HlVd2a5NUHp-IP"
  $"Server Url" <- "https://api.systemlinkcloud.com/"
  w1 = bool FALSE  # Stop Event
  Create User Event[EventName="Stop Event"](user event data type=w1) -> (error out=w2, user event out=w3)
  call "Create All Message Queues.gvi"(error in=w2) -> (message queues=w4, error out=w5)
  Property Node(instance in=w4) -> ("UI"=w6)
  s1 = "UI Data.gtype" {all zero or empty}  # shift register
  while {
    call "Dequeue Message.gvi"(message queue in=w6, error in=w5) -> (message queue out=w7, message=w8, message data=w9, error out=w10)
    # s1: Data
    # w3: Stop Event
    case (w8) ignore case {  # Message Cases
      frame "Initialize" {
        Property Node(instance in=s1, "String <Replace Me>"="Initial Message") -> (instance out=w12)
        call "Enqueue Message (Single).gvi"(message queue in=w7, message="Update Display", message data="Initial Message", error in=w10) -> (error out=w11)
        Property Node(instance in=reference to "PV-Connecting Solar Panels", "Value"="")
        # Bundle a sample string value.
        Property Node(instance in=reference to "PV-Load 4", "Value"="")
        Property Node(instance in=reference to "PV-Temperature, ºC", "Value"=0)
        Property Node(instance in=reference to "MV-Cooling Conditions", "Value"="")
        Property Node(instance in=reference to "PV-Load 3", "Value"="")
        Property Node(instance in=reference to "PV-Intensity, W/m2", "Value"=0)
        Property Node(instance in=reference to "PV-Heating Conditions", "Value"="")
        Property Node(instance in=reference to "PV-Load 2", "Value"="")
        Property Node(instance in=reference to "PV-Panel Tilt Angle, º", "Value"=0)
        Property Node(instance in=reference to "PV-Dimming Conditions", "Value"="")
        Property Node(instance in=reference to "PV-Load 1", "Value"="")
        Property Node(instance in=reference to "PV-Angle Of Rotation, º", "Value"=0)
        Property Node(instance in=reference to "MV-Connecting Solar Panels", "Value"="")
        Property Node(instance in=reference to "MV-Load 4", "Value"="")
        Property Node(instance in=reference to "PV-Voltage, V", "Value"=0)
        Property Node(instance in=reference to "PV-Cooling Conditions", "Value"="")
        Property Node(instance in=reference to "MV-Load 3", "Value"="")
        Property Node(instance in=reference to "PV-Current, A", "Value"=0)
        Property Node(instance in=reference to "MV-Heating Conditions", "Value"="")
        Property Node(instance in=reference to "MV-Load 2", "Value"="")
        Property Node(instance in=reference to "PV-Load,Ohm", "Value"=0)
        Property Node(instance in=reference to "MV-Dimming Conditions", "Value"="")
        Property Node(instance in=reference to "MV-Load 1", "Value"="")
        Property Node(instance in=reference to "MV-Light Source Power, W", "Value"="")
        Property Node(instance in=reference to "MV-Panel Tilt Angle, º", "Value"="")
        w13 = default
      }
      frame "Something" {
        # #CodeNeeded - Perform whatever actions correspond to the "Something" message.
        # Send string to "Update Display" message
        call "Enqueue Message (Single).gvi"(message queue in=w7, message="Update Display", message data="\"Do Something\" button pressed", error in=w10) -> (error out=w11)
        w12 = s1
        w13 = default
      }
      frame "Something Else" {
        # #CodeNeeded - Perform whatever actions correspond to the "Something Else" message.
        # Send string to "Update Display" message
        call "Enqueue Message (Single).gvi"(message queue in=w7, message="Update Display", message data="\"Do Something Else\" button pressed", error in=w10) -> (error out=w11)
        w12 = s1
        w13 = default
      }
      frame "Update Display" {
        # #CodeRecommended - If you wish to decouple the Message Handling Loop from your user interface, consider creating User Events (like the "Stop" event in this VI) to message the Event Handling Loop whenever the user interface needs updating.
        Variant To Data(error in (no error)=w10, type=string "", variant=w9) -> (data=w14, error out=w11)
        $"Display <Replace Me>" <- w14
        w12 = s1
        w13 = default
      }
      frame "Error" {
        Variant To Data(error in (no error)=w10, type=no error, variant=w9) -> (data=w15, error out=w11)
        # #CodeRecommended - Consider creating a system for logging errors in some way. These errors are for notification purposes only. Handling of specific errors should be performed in the message frames that generated the error.
        # #CodeRecommended - If you ever change the name of this "Error" message, you'll need to update the name in the Check Loop Error.vi as well.
        call "Display Error.gvi"(error in=w15)
        w12 = s1
        w13 = default
      }
      frame "---Copy This Frame---" {
        Merge Errors(w10) -> (error out=w11)
        w12 = s1
        w13 = default
      }
      frame "Exit" {
        # Release the message queue reference
        Release Queue(error in=w10, queue=w7) -> (error out=w16)
        # #CodeNeeded - Add any required cleanup code here. Note that if 'Exit' was called as a result of an error, an error dialog will be displayed. Add any custom error handling for an 'Exit' condition here as well.
        Generate User Event(event data=TRUE, user event=w3) -> (error out=w17)
        Merge Errors(w17, w16) -> (error out=w11)
        # Stop the VI
        w12 = s1
        w13 = TRUE
      }
      frame Default {
        w18 = "The invalid message string \"%s\" was received in the Message Handling Loop."
        Format Into String(formatString=w18, w8) -> w19
        call "Build Error Cluster.gvi"(code=1, description=w19) -> (error out=w11)
        w12 = s1
        w13 = default
      }
      frame "Send D To Server" {
        Variant To Data(type=string[] [], variant=w9) -> (data=w20)
        Array Index(array=w20) -> (out0[0]=w21, out1[1]=w22)
        Floating Point String To Number(string=w22) -> (number=w23)
        call "Send D To Server.gvi"(Time Stamp=1904-01-01T00:00:00Z, Server Url=$"API Key", API Key=$"Server Url", Data Type="Double", Path=w21, Value=w23)
        w11 = w10
        w12 = s1
        w13 = default
      }
      frame "Send S To Server" {
        Variant To Data(type=string[] [], variant=w9) -> (data=w24)
        Array Index(array=w24) -> (out0[0]=w25, out1[1]=w26)
        call "Send S To Server.gvi"(Time Stamp=1904-01-01T00:00:00Z, API Key=$"API Key", Server Url=$"Server Url", Data Type="String", Path=w25, Value=w26)
        w11 = w10
        w12 = s1
        w13 = default
      }
    }
    call "Error Handler - Message Handling Loop.gvi"(message queue in=w7, error in=w11) -> (dup error in=w27)
    next s1 = w12
    stop if w13
  }
  Register For Events("Stop Event"=w3) -> (event registration refnum out=w28)
  s2 = w28  # shift register
  while {
    event (dynamic events = s2) {
      on "Do Something <Replace Me>" Value changed {
        # #CodeNeeded - Send the appropriate message for this user interface event.
        call "Enqueue Message (Single).gvi"(message queue in=w6, message="Something") -> (message queue out=w31, error out=w30)
        w29 = default
      }
      on "Do Something Else <Replace Me>" Value changed {
        # #CodeNeeded - Send the appropriate message for this user interface event.
        call "Enqueue Message (Single).gvi"(message queue in=w6, message="Something Else") -> (message queue out=w31, error out=w30)
        w29 = default
      }
      on "Exit" Value changed {
        call "Enqueue Message (Single).gvi"(priority message=TRUE, message queue in=w6, message="Exit") -> (message queue out=w31, error out=w30)
        w29 = default
      }
      on dynamic event 0 {
        # The Message Handling Loop processed an "Exit" message, which fired this event to stop the Event Handling Loop.
        $"Display <Replace Me>" <- "\"Exit\" button pressed"
        w29 = TRUE
        w30 = default
        w31 = w6
      }
      on "Window" Close? {
        call "Enqueue Message (Single).gvi"(priority message=TRUE, message queue in=w6, message="Exit") -> (message queue out=w31)
        Event Filter("Discard?"=TRUE)
        w29 = default
        w30 = default
      }
      on "PV-Current, A" Value changed {
        Event Data() -> ("New Value"=w32)
        Number To Fractional String(number=w32) -> (F-format string=w33)
        Build Array("PV-Current", w33) -> w34
        call "Enqueue Message (Single).gvi"(message queue in=w6, message="Send D To Server", message data=w34) -> (message queue out=w31)
        w29 = default
        w30 = default
      }
      on "PV-Voltage, V" Value changed {
        Event Data() -> ("New Value"=w35)
        Number To Fractional String(number=w35) -> (F-format string=w36)
        Build Array("PV-Load", w36) -> w37
        call "Enqueue Message (Single).gvi"(message queue in=w6, message="Send D To Server", message data=w37) -> (message queue out=w31)
        w29 = default
        w30 = default
      }
      on "PV-Load,Ohm" Value changed {
        Event Data() -> ("New Value"=w38)
        Number To Fractional String(number=w38) -> (F-format string=w39)
        Build Array("PV-Voltage", w39) -> w40
        call "Enqueue Message (Single).gvi"(message queue in=w6, message="Send D To Server", message data=w40) -> (message queue out=w31)
        w29 = default
        w30 = default
      }
      on "PV-Temperature, ºC" Value changed {
        Event Data() -> ("New Value"=w41)
        Number To Fractional String(number=w41) -> (F-format string=w42)
        Build Array("PV-Temperature", w42) -> w43
        call "Enqueue Message (Single).gvi"(message queue in=w6, message="Send D To Server", message data=w43) -> (message queue out=w31)
        w29 = default
        w30 = default
      }
      on "PV-Intensity, W/m2" Value changed {
        Event Data() -> ("New Value"=w44)
        Number To Fractional String(number=w44) -> (F-format string=w45)
        Build Array("PV-Intensity", w45) -> w46
        call "Enqueue Message (Single).gvi"(message queue in=w6, message="Send D To Server", message data=w46) -> (message queue out=w31)
        w29 = default
        w30 = default
      }
      on "PV-Panel Tilt Angle, º" Value changed {
        Event Data() -> ("New Value"=w47)
        Number To Fractional String(number=w47) -> (F-format string=w48)
        Build Array("PV-Panel Tilt Angle", w48) -> w49
        call "Enqueue Message (Single).gvi"(message queue in=w6, message="Send D To Server", message data=w49) -> (message queue out=w31)
        w29 = default
        w30 = default
      }
      on "PV-Angle Of Rotation, º" Value changed {
        Event Data() -> ("New Value"=w50)
        Number To Fractional String(number=w50) -> (F-format string=w51)
        Build Array("PV-Angle Of Rotation", w51) -> w52
        call "Enqueue Message (Single).gvi"(message queue in=w6, message="Send D To Server", message data=w52) -> (message queue out=w31)
        w29 = default
        w30 = default
      }
      on "PV-Connecting Solar Panels" Value changed {
        Event Data() -> ("New Value"=w53)
        Build Array("PV-Connecting Solar Panels", w53) -> w54
        call "Enqueue Message (Single).gvi"(message queue in=w6, message="Send S To Server", message data=w54) -> (message queue out=w31)
        w29 = default
        w30 = default
      }
      on "PV-Cooling Conditions" Value changed {
        Event Data() -> ("New Value"=w55)
        Build Array("PV-Cooling Conditions", w55) -> w56
        call "Enqueue Message (Single).gvi"(message queue in=w6, message="Send S To Server", message data=w56) -> (message queue out=w31)
        w29 = default
        w30 = default
      }
      on "PV-Heating Conditions" Value changed {
        Event Data() -> ("New Value"=w57)
        Build Array("PV-Heating Conditions", w57) -> w58
        call "Enqueue Message (Single).gvi"(message queue in=w6, message="Send S To Server", message data=w58) -> (message queue out=w31)
        w29 = default
        w30 = default
      }
      on "PV-Dimming Conditions" Value changed {
        Event Data() -> ("New Value"=w59)
        Build Array("PV-Dimming Conditions", w59) -> w60
        call "Enqueue Message (Single).gvi"(message queue in=w6, message="Send S To Server", message data=w60) -> (message queue out=w31)
        w29 = default
        w30 = default
      }
      on "PV-Load 1" Value changed {
        Event Data() -> ("New Value"=w61)
        Build Array("PV-Load 1", w61) -> w62
        call "Enqueue Message (Single).gvi"(message queue in=w6, message="Send S To Server", message data=w62) -> (message queue out=w31)
        w29 = default
        w30 = default
      }
      on "PV-Load 2" Value changed {
        Event Data() -> ("New Value"=w63)
        Build Array("PV-Load 2", w63) -> w64
        call "Enqueue Message (Single).gvi"(message queue in=w6, message="Send S To Server", message data=w64) -> (message queue out=w31)
        w29 = default
        w30 = default
      }
      on "PV-Load 3" Value changed {
        Event Data() -> ("New Value"=w65)
        Build Array("PV-Load 3", w65) -> w66
        call "Enqueue Message (Single).gvi"(message queue in=w6, message="Send S To Server", message data=w66) -> (message queue out=w31)
        w29 = default
        w30 = default
      }
      on "PV-Load 4" Value changed {
        Event Data() -> ("New Value"=w67)
        Build Array("PV-Load 4", w67) -> w68
        call "Enqueue Message (Single).gvi"(message queue in=w6, message="Send S To Server", message data=w68) -> (message queue out=w31)
        w29 = default
        w30 = default
      }
    }
    call "Error Handler - Event Handling Loop.gvi"(message queue in=w31, error in=w30) -> (dup error in=w69)
    stop if w29
  }
  Unregister For Events(error in=w69, event registration refnum=s2) -> (error out=w70)
  Merge Errors(w70, w27) -> (error out=w71)
  Destroy User Event(error in=w71, user event=w3)
  while {
    call "Open Configuration API Key.gvi"(server url=$"Server Url", api key=$"API Key", error in=$"error in_2") -> (configuration=w72, error out=w73)
    w74 = ["MV-Connecting Solar Panels ", "MV-Cooling Conditions", "MV-Heating Conditions", "MV-Dimming Conditions", "MV-Panel Tilt Angle", "MV-Light Source Power", "MV-Load 1", "MV-Load 2", "MV-Load 3", "MV-Load 4"]
    call "Query Tags.gvi"(paths=w74, error in=w73, configuration=w72) -> (tags=w75, error out=w76)
    for {
      w77 = each element of w75
      Property Node(instance in=w77) -> ("Path"=w79, "Datatype"=w80)
      call "Open Tag.gvi"(path=w79, data type=w80, error in=w76, configuration=w72) -> (tag=w81, error out=w82)
      call "Read Tag (String).gvi"(tag in=w81, error in=w82) -> (tag out=w83, value=w84, error out=w85)
      append w84 to w78
    }
    Array Index(array=w78) -> (out0[0]=w86, out1[1]=w87, out2[2]=w88, out3[3]=w89, out4[4]=w90, out5[5]=w91, out6[6]=w92, out7[7]=w93, out8[8]=w94, out9[9]=w95)
    $"MV-Connecting Solar Panels" <- w86
    $"MV-Cooling Conditions" <- w87
    $"MV-Heating Conditions" <- w88
    $"MV-Dimming Conditions" <- w89
    $"MV-Panel Tilt Angle, º" <- w90
    $"MV-Light Source Power, W" <- w91
    $"MV-Load 1" <- w92
    $"MV-Load 2" <- w93
    $"MV-Load 3" <- w94
    $"MV-Load 4" <- w95
    Wait(time to wait=500)
    call "Close Tag (Single).gvi"(tag=w83, error in=w85) -> (error out=w96)
    call "Close Configuration.gvi"(configuration=w72, error in=w96) -> (error out=w97)
    $"error out_2" <- w97
    stop if $Boolean_2
  }
  while {
    event {
      on "MV-Connecting Solar Panels" Value changed {
        $"Round LED" <- TRUE
        Event Data() -> ("New Value"=w98)
        $"Connecting Solar Panels" <- w98
      }
      on "MV-Cooling Conditions" Value changed {
        Event Data() -> ("New Value"=w99)
        $"Cooling Conditions_2" <- w99
      }
    }
    stop if $stop
  }
