vi "SLC.gvi"   [LabVIEW NXG 5.0.0]
panel controls:
  "error in_6": error
  "PV-TT": f64
  "PV-IT": f64
  "error in_3": error
  "PV-AT": f64
  "PV-AR": f64
  "Button": bool
  "error in_2": error
  "error in_4": error
  "PV-I": f64
  "PV-U": f64
  "PV-R": f64
  "Boolean": bool
  "Cycle read": bool
  "Boolean_2": bool
  "PV-DC": string
panel indicators:
  "error out_3": error
  "error out_4": error
  "Temperature, ºC_2": f64
  "Intensity, W/m2_2": f64
  "Panel tilt angle, º_2": f64
  "error out_2": error
  "MV-CS": string
  "MV-CC": string
  "MV-HC": string
  "MV-DC": string
  "MV-A": string
  "MV-P": string
  "error out_5": error
  "MV-R4": string
  "MV-R3": string
  "MV-R2": string
  "MV-R1": string
  "PV-R4_2": string
types:
  T1 = enum{"Initialize", "PV-TT", "PV-IT", "PV-AT", "PV-AR1", "PV-AR2", "PV-U", "PV-I", "PV-R", "SEND"}
uses:
  NI::Skyline::Configuration::Open Configuration API Key.gvi
  NI::Skyline::TagHTTP::Query Tags.gvi
  NI::Skyline::TagHTTP::Open Tag.gvi
  NI::Skyline::TagHTTP::Read Tag (DBL).gvi
  NI::Skyline::TagHTTP::Close Tag (Single).gvi
  NI::Skyline::Configuration::Close Configuration.gvi
  NI::Skyline::TagHTTP::Write Tag (DBL).gvi
  NI::Skyline::TagHTTP::Read Tag (String).gvi
diagram:
  disable {
    frame Enabled { }
    frame Disabled {
      call "Open Configuration API Key.gvi"(server url="https://api.systemlinkcloud.com/", api key="zYUbuW0YNkg1G__lXfJiGVBNWME-HlVd2a5NUHp-IP", error in=$"error in_3") -> (configuration=w1, error out=w2)
      call "Query Tags.gvi"(paths=["PV-TT", "PV-IT", "PV-AT"], error in=w2, configuration=w1) -> (tags=w3, error out=w4)
      for {
        w5 = each element of w3
        Wait(time to wait=400)
        Property Node(instance in=w5) -> ("Path"=w7, "Datatype"=w8)
        call "Open Tag.gvi"(path=w7, data type=w8, error in=w4, configuration=w1) -> (tag=w9, error out=w10)
        call "Read Tag (DBL).gvi"(tag in=w9, error in=w10) -> (tag out=w11, value=w12, error out=w13)
        append w12 to w6
      }
      call "Close Tag (Single).gvi"(tag=w11, error in=w13) -> (error out=w14)
      call "Close Configuration.gvi"(configuration=w1, error in=w14) -> (error out=w15)
      $"error out_4" <- w15
      Array Index(array=w6) -> (out0[_]=w16, out1[_]=w17, out2[_]=w18)
      $"Temperature, ºC_2" <- w16
      $"Intensity, W/m2_2" <- w17
      $"Panel tilt angle, º_2" <- w18
    }
  }
  Obtain Queue(element data type=T1 "Initialize") -> (queue out=w19)
  Enqueue Element(element=T1 "Initialize", queue=w19) -> (queue out=w20)
  while {
    event {
      on "PV-TT" Value changed {
        Enqueue Element(element="PV-TT", queue=w20)
      }
      on "PV-IT" Value changed {
        Enqueue Element(element="PV-IT", queue=w20)
      }
      on "PV-AT" Value changed {
        Enqueue Element(element="PV-AT", queue=w20)
      }
      on "PV-AR" Value changed {
        Enqueue Element(element="PV-AR1", queue=w20)
      }
      on "Button" Value changed {
        Enqueue Element(element="SEND", queue=w20)
      }
      on "PV-U" Value changed {
        Enqueue Element(element="PV-U", queue=w20)
      }
      on "PV-I" Value changed {
        Enqueue Element(element="PV-I", queue=w20)
      }
      on "PV-R" Value changed {
        Enqueue Element(element="PV-R", queue=w20)
      }
    }
    stop if FALSE
  }
  while {
    Dequeue Element(queue=w20) -> (element=w21, queue out=w22)
    case (w21) {
      frame "Initialize", Default { }
      frame "PV-TT" { }
      frame "PV-IT" { }
      frame "PV-AT" { }
      frame "PV-AR1" { }
      frame "PV-AR2" { }
      frame "PV-U" { }
      frame "PV-I" { }
      frame "PV-R" { }
      frame "SEND" {
        call "Open Configuration API Key.gvi"(server url="https://api.systemlinkcloud.com/", api key="zYUbuW0YNkg1G__lXfJiGVBNWME-HlVd2a5NUHp-IP", error in=$"error in_6") -> (configuration=w23)
        Property Node(instance in=reference to "PV-TT") -> ("Value"=w24)
        Property Node(instance in=reference to "PV-IT") -> ("Value"=w25)
        Property Node(instance in=reference to "PV-AT") -> ("Value"=w26)
        Property Node(instance in=reference to "PV-AR") -> ("Value"=w27)
        Property Node(instance in=reference to "PV-I") -> ("Value"=w28)
        Property Node(instance in=reference to "PV-R") -> ("Value"=w29)
        Property Node(instance in=reference to "PV-U") -> ("Value"=w30)
        Build Array(w24, w25, w26, w27, w28, w29, w30) -> w31
        for {
          w32 = each element of ["PV-TT", "PV-IT", "PV-AT", "PV-AR", "PV-I", "PV-R", "PV-U"]
          w33 = each element of w31
          Wait(time to wait=200)
          call "Open Tag.gvi"(path=w32, data type="Double", configuration=w23) -> (tag=w34)
          call "Write Tag (DBL).gvi"(tag in=w34, value=w33) -> (tag out=w35, error out=w36)
        }
        call "Close Tag (Single).gvi"(tag=w35, error in=w36) -> (error out=w37)
        call "Close Configuration.gvi"(configuration=w23, error in=w37) -> (error out=w38)
        $"error out_3" <- w38
      }
    }
    stop if $Boolean
  }
  while {
    call "Open Configuration API Key.gvi"(server url="https://api.systemlinkcloud.com/", api key="zYUbuW0YNkg1G__lXfJiGVBNWME-HlVd2a5NUHp-IP", error in=$"error in_2") -> (configuration=w39, error out=w40)
    call "Query Tags.gvi"(paths=["MV-CS", "MV-CC", "MV-HC", "MV-DC", "MV-A", "MV-P"], error in=w40, configuration=w39) -> (tags=w41, error out=w42)
    for {
      w43 = each element of w41
      Property Node(instance in=w43) -> ("Path"=w45, "Datatype"=w46)
      call "Open Tag.gvi"(path=w45, data type=w46, error in=w42, configuration=w39) -> (tag=w47, error out=w48)
      call "Read Tag (String).gvi"(tag in=w47, error in=w48) -> (tag out=w49, value=w50, error out=w51)
      append w50 to w44
    }
    Array Index(array=w44) -> (out0[0]=w52, out1[1]=w53, out2[2]=w54, out3[3]=w55, out4[4]=w56, out5[5]=w57)
    $"MV-CS" <- w52
    $"MV-CC" <- w53
    Wait(time to wait=500)
    $"MV-HC" <- w54
    $"MV-DC" <- w55
    $"MV-A" <- w56
    $"MV-P" <- w57
    call "Close Tag (Single).gvi"(tag=w49, error in=w51) -> (error out=w58)
    call "Close Configuration.gvi"(configuration=w39, error in=w58) -> (error out=w59)
    $"error out_2" <- w59
    stop if $Boolean_2
  }
  disable {
    frame Enabled { }
    frame Disabled {
      while {
        call "Open Configuration API Key.gvi"(server url="https://api.systemlinkcloud.com/", api key="zYUbuW0YNkg1G__lXfJiGVBNWME-HlVd2a5NUHp-IP", error in=$"error in_4") -> (configuration=w60, error out=w61)
        call "Query Tags.gvi"(paths=["MV-R4", "MV-R3", "MV-R2", "MV-R1"], error in=w61, configuration=w60) -> (tags=w62, error out=w63)
        for {
          w64 = each element of w62
          Property Node(instance in=w64) -> ("Path"=w66, "Datatype"=w67)
          call "Open Tag.gvi"(path=w66, data type=w67, error in=w63, configuration=w60) -> (tag=w68, error out=w69)
          call "Read Tag (String).gvi"(tag in=w68, error in=w69) -> (tag out=w70, value=w71, error out=w72)
          append w71 to w65
        }
        Array Index(array=w65) -> (out0[0]=w73, out1[1]=w74, out2[2]=w75, out3[3]=w76)
        $"MV-R4" <- w73
        $"MV-R3" <- w74
        Wait(time to wait=500)
        $"MV-R2" <- w75
        $"MV-R1" <- w76
        call "Close Tag (Single).gvi"(tag=w70, error in=w72) -> (error out=w77)
        call "Close Configuration.gvi"(configuration=w60, error in=w77) -> (error out=w78)
        $"error out_5" <- w78
        w79 = $"Cycle read"
        stop if w79
      }
    }
  }
