vi "Custom Chart.gvi"   [LabVIEW NXG 4.0.0]
inputs:
  "Command Graph": "Command Chart.gtype" = "Initialize"
  "X": f64
  "Y": f64
outputs:
  "Table out": f64[][]
  "Chart": cluster{"Element 1": f64[], "Element 2": f64[]}
types:
  "Command Chart.gtype" = enum{"Initialize", "Write/Read ", "Graph", "Clear Table", "Delete last", "Clear Chart"}
diagram:
  s1 = uninitialised  # shift register
  s2 = uninitialised  # shift register
  s3 = uninitialised  # shift register
  while {
    case ($"Command Graph") {
      frame "Initialize", Default {
        w5 = f64[] []  # X
        w6 = f64[] []  # Y
        w1 = w5
        w2 = w6
        w3 = f64[][] []
        w4 = default
      }
      frame "Write/Read " {
        Insert Into Array(inArray=s1, new=$X) -> w1
        Insert Into Array(inArray=s2, new=$Y) -> w2
        Build Array(w1, w2) -> w7
        Transpose 2D Array(2D array=w7) -> (transposed array=w3)
        w4 = default
      }
      frame "Graph" {
        Build Cluster(s1, s2) -> w4
        w1 = default
        w2 = default
        w3 = default
      }
      frame "Clear Table" {
        w1 = default
        w2 = default
        w3 = f64[][] []
        w4 = default
      }
      frame "Delete last" {
        Delete From Array(inArray=s3) -> w3
        w1 = default
        w2 = default
        w4 = default
      }
      frame "Clear Chart" {
        w8 = cluster{"Element 1": f64[], "Element 2": f64[]} {all zero or empty}
        w1 = default
        w2 = default
        w3 = default
        w4 = w8
      }
    }
    next s1 = w1
    next s2 = w2
    next s3 = w3
    stop if TRUE
  }
  $Chart <- w4
  $"Table out" <- s3
