vi "XY Graph new.gvi"   [LabVIEW NXG 4.0.0]
inputs:
  "New Y": f64
  "Chart History": i32
  "dt": i32
  "XY Graph new.Command to graph": "XY Graph new.Command to graph.gtype" = "Initialize"
  "Error in": error
outputs:
  "Error out": error
  "Output": waveform<f64>
types:
  "XY Graph new.Command to graph.gtype" = enum{"Initialize", "Add Y", "Clear Graph", "Change graph history"}
  T1 = cluster{"Numeric Constant": f64, "Timestamp Constant": timestamp}
diagram:
  Divide(x=$dt, y=1000) -> w1
  s1 = uninitialised  # shift register
  s2 = uninitialised  # shift register
  while {
    case ($"XY Graph new.Command to graph") {
      frame "Initialize" {
        w2 = $"Chart History"
        w3 = T1[] []
        w4 = waveform<f64> {dt=0.5, Y=[]}
      }
      frame "Add Y", Default {
        Get Current Time() -> (current time=w5)
        Property Node(instance in=T1 {all zero or empty}, "Numeric Constant"=$"New Y", "Timestamp Constant"=w5) -> (instance out=w6)
        Build Array(s1, w6) -> w7
        Array Size(array=w7) -> (size(s)=w8)
        Is Greater(x=w8, y=s2) -> w9
        case (w9) {
          frame False, Default {
            w3 = w7
          }
          frame True {
            Reverse 1D Array(array=w7) -> (reversed array=w10)
            Array Subset(array=w10, index0=s2) -> w11
            Reverse 1D Array(array=w11) -> (reversed array=w3)
          }
        }
        for {
          w12 = each element of w3
          Property Node(instance in=w12) -> ("Numeric Constant"=w14)
          append w14 to w13
        }
        Array Index(array=w3) -> (out0[_]=w15)
        Property Node(instance in=w15) -> ("Timestamp Constant"=w16)
        Build Waveform Node(Y=w13, dt=w1, t0=w16) -> (output waveform=w4)
        w2 = s2
      }
      frame "Clear Graph" {
        w2 = default
        w3 = T1[] []
        w4 = waveform<f64> {dt=0.5, Y=[]}
      }
      frame "Change graph history" {
        w2 = $"Chart History"
        w3 = s1
        w4 = default
      }
    }
    next s1 = w3
    next s2 = w2
    stop if TRUE
  }
  $Output <- w4
  $"Error out" <- $"Error in"
