vi "Load selection.gvi"   [LabVIEW NXG 5.0.0]
inputs:
  "List box": "Listbox reference"[]
  "Value": i32[] = [1000, 2000, 3000]
outputs:
  "Sum": i32
  "Load": string
diagram:
  Property Node(instance in=$"List box") -> ("Value"=w1)
  s1 = ""  # shift register
  for {
    w2 = each element of w1
    Array Index(array=$Value) -> (out0[w2]=w4)
    Number To Decimal String(number=w4) -> (decimal integer string=w5)
    Concatenate Strings(s1, w5, ",") -> w6
    append w4 to w3
    next s1 = w6
  }
  Add Array Elements(numeric array=w3) -> (sum=w7)
  $Sum <- w7
  $Load <- s1
