vi "Main.Lab 1.2.gviweb"   [LabVIEW NXG 4.0.0]
panel controls:
  "Connecting Solar Panels": i32 = -1
  "Solar panel tilt angle, º": f64
  "Power setting for the light source, W": f64
  "Cooling conditions": i32 = -1
  "Clear/Tab 1": bool
  "Isc": f64
  "Uoc": f64
  "Data Grid #3.1": T1[]
  "Save in memory": bool
  "Slot name_": string
  "Write/Slot name": i32 = "Slot 1"(0)
  "Isc_3": f64
  "Uoc_3": f64
  "button_21": bool
  "Isc_4": f64
  "Uoc_6": f64
  "button_23": bool
  "Calculate P/J": bool
  "Isc_2": f64
  "Uoc_2": f64
  "Isc_5": f64
  "Uoc_7": f64
  "button_29": bool
  "Dimming conditions": i32 = -1
  "Parallel connection": i32 = -1
  "Series connection": i32 = -1
  "Heating conditions": i32 = -1
  "1х, Ohm": i32[]
  "10х": i32[]
  "100х": i32[]
  "Set Load": bool
  "button_39": bool
  "Data Grid": T2[]
  "Parameter Y": i32 = -1
  "Parameter X": i32 = -1
  "slot#": i32[]
  "Calculation": i32
  "1000х": i32[]
  "History graph": i16 = 400
  "History graph_2": i16 = 400
  "History graph_3": i16 = 400
  "button_32": bool
  "Clear all": bool
  "Read/Clear/Slot number": i32 = "1"(0)
  "Manual/Automatic": enum{"Manual", "Automatic"} = "Manual"
  "button_30": bool
  "Clear memory buffer": bool
  "Read/Table": f64[][]
  "Write/Cluster of Measurements to buffer": T3 = {"Slot name"="", "Headers"=["U, V", "I, mA", "R, Ohm", "Angle, º", "J, W / m²", "T, ºC"], "Measurements"=[[5, 10, 0, 0, 202], [6, 11, 0, 0, 200], [7, 12, 0, 0, 201], [8, 13, 0, 0, 201], [0, 0, 0, 0, 0], [0, 0, 0, 0, 0], [8, 14, 0, 0, 202], [0, 0, 0, 0, 0], [0, 0, 0, 0, 0], [9, 15, 0, 0, 203]]}
  "History graph_4": i16 = 400
  "Calc/Slot number": i32 = "1"(0)
panel indicators:
  "start/stop lab": bool
  "button": bool
  "button_2": bool
  "Graph_2": f64[]
  "button_3": bool
  "button_4": bool
  "button_7": bool
  "button_8": bool
  "Graph_5": f64[]
  "button_16": bool
  "button_17": bool
  "button_19": bool
  "button_20": bool
  "Uoc_4": f64
  "Graph_9": f64[]
  "button_22": bool
  "button_25": bool
  "button_26": bool
  "Graph_8": f64[]
  "button_9": bool
  "button_10": bool
  "button_27": bool
  "button_28": bool
  "Uoc_8": f64
  "Total Load, Ohm": i32
  "URL Image_2": string
  "URL Image_3": string
  "Graph_3": f64[]
  "button_6": bool
  "Graph_4": f64[]
  "button_12": bool
  "button_11": bool
  "button_13": bool
  "URL Image_4": string
  "button_14": bool
  "button_15": bool
  "button_34": bool
  "Memory slot": string[]
  "Read/Slot name": string
  "Read/Headers": string[]
  "URL Image_5": string
  "LED": bool
  "button_38": bool
  "Graph_6": f64[][]
  "button_18": bool
  "button_31": bool
  "URL Image_6": string
  "URL Image_7": string
  "Graph P": cluster{"Element 1": f64[], "Element 2": f64[]}
  "transposed array": f64[][]
  "Read/Slot name": string
types:
  T1 = cluster{"Parameter X": string, "Parameter Y": string}
  T2 = cluster{"A": string, "String": string, "String_2": string, "String_3": string, "String_4": string}
  T3 = cluster{"Slot name": string, "Headers": string[], "Measurements": f64[][]}
  "Buttons WebVI.gtype" = enum{"Initialize ", "Measurements/Save in Memory Buffer", "Measurements/Read from Memory Buffer", "Memory Buffer/Clear", "Memory Buffer/Clear all", "Load Selection", "Set Load", "Calculations/Read Slot Memory", "Calculations/Array/Read Slot Memory", "Calculate/Tab 1", "Clear/Tab 1", "Update Display"}
  "Buttons WebVI Calc.gtype" = enum{"Initialize ", "Calculations/Read Slot Memory", "Calculations/Array/Read Slot Memory", "Calculations/Tab 1", "Clear/Tab 1"}
uses:
  WebApp::Memory Buffer::Memory buffer.gvi
  WebApp::Load Selection::Load selection.gvi
diagram:
  w1 = "Buttons WebVI.gtype" "Initialize "  # Buttons WebVI/Measurments
  Obtain Queue(element data type=w1, name="Queue 2") -> (queue out=w2)
  Enqueue Element(element=w1, queue=w2) -> (queue out=w3)
  while {
    event {
      on "Save in memory" Value changed {
        w4 = "Measurements/Save in Memory Buffer"  # Buttons WebVI
        Enqueue Element(element=w4, queue=w3)
      }
      on "Read/Clear/Slot number" Value changed {
        w5 = "Measurements/Read from Memory Buffer"  # Buttons WebVI
        Enqueue Element(element=w5, queue=w3)
      }
      on "Clear memory buffer" Value changed {
        w6 = "Memory Buffer/Clear"  # Buttons WebVI
        Enqueue Element(element=w6, queue=w3)
      }
      on "Clear all" Value changed {
        w7 = "Memory Buffer/Clear all"  # Buttons WebVI
        Enqueue Element(element=w7, queue=w3)
      }
      on "1000х" Value changed; "100х" Value changed; "10х" Value changed; "1х, Ohm" Value changed; "Manual/Automatic" Value changed {
        w8 = "Load Selection"  # Buttons WebVI/Measurments
        Enqueue Element(element=w8, queue=w3)
      }
      on "Set Load" Value changed { }
    }
    stop if FALSE
  }
  while {
    Dequeue Element(queue=w3) -> (element=w9, queue out=w10)
    case (w9) {
      frame "Initialize ", Default {
        call "Memory buffer.gvi"(Initialize/Max Number of slots memory=10, Command to buffer="Initialize") -> (Slot name indicator=w11)
        $"Memory slot" <- w11
      }
      frame "Measurements/Save in Memory Buffer" {
        w12 = ["U, V", "I, mA", "R, Ohm", "Angle, º", "J, W / m²", "T, ºC"]
        w13 = "Write"  # Memory buffer.Command to buffer
        call "Memory buffer.gvi"(Write/Cluster of Measurements to buffer=$"Write/Cluster of Measurements to buffer", Write/Read/Clear/Number of slot=$"Write/Slot name", Write/Name of slot=$"Slot name_", Write/Headers=w12, Command to buffer=w13) -> (Slot name indicator=w14, Save all=w15, R4=w16)
        $"Memory slot" <- w14
        $"Read/Slot name" <- w15
        $"Read/Table" <- w16
      }
      frame "Measurements/Read from Memory Buffer" {
        w17 = "Read"  # Memory buffer.Command to buffer
        call "Memory buffer.gvi"(Write/Read/Clear/Number of slot=$"Read/Clear/Slot number", Command to buffer=w17) -> (Read/Slot=w18, Save all=w19, R3=w20)
        $"Read/Table" <- w18
        $"Read/Slot name" <- w19
        $"Read/Headers" <- w20
      }
      frame "Memory Buffer/Clear" {
        w21 = "Clear"  # Memory buffer.Command to buffer
        call "Memory buffer.gvi"(Write/Read/Clear/Number of slot=$"Read/Clear/Slot number", Command to buffer=w21) -> (Slot name indicator=w22, Read/Slot=w23, Save all=w24)
        $"Memory slot" <- w22
        $"Read/Table" <- w23
        $"Read/Slot name" <- w24
      }
      frame "Memory Buffer/Clear all" {
        w25 = "Clear all"  # Memory buffer.Command to buffer
        call "Memory buffer.gvi"(Write/Read/Clear/Number of slot=$"Read/Clear/Slot number", Command to buffer=w25) -> (Slot name indicator=w26, Read/Slot=w27)
        $"Memory slot" <- w26
        $"Read/Table" <- w27
      }
      frame "Load Selection" {
        case ($"Manual/Automatic") {
          frame "Manual", Default {
            Property Node(instance in=reference to "1000х", "Disabled"=FALSE)
            Property Node(instance in=reference to "100х", "Disabled"=FALSE)
            call "Load selection.gvi"(List box=reference to "100х", Value=[100, 200, 400, 500]) -> (Sum=w28)
            Property Node(instance in=reference to "10х", "Disabled"=FALSE) -> (instance out=w29)
            call "Load selection.gvi"(List box=w29, Value=[10, 20, 40, 50]) -> (Sum=w30)
            call "Load selection.gvi"(List box=reference to "1х, Ohm", Value=[1, 2, 4, 5]) -> (Sum=w31)
            call "Load selection.gvi"(List box=reference to "1000х", Value=[1000, 2000, 3000]) -> (Sum=w32)
            Add(w32, w28, w30, w31) -> w33
            $"Total Load, Ohm" <- w33
            Property Node(instance in=reference to "Set Load", "Disabled"=FALSE)
            Property Node(instance in=reference to "1х, Ohm", "Disabled"=FALSE)
            Property Node(instance in=reference to "Total Load, Ohm", "Disabled"=FALSE)
          }
          frame "Automatic" {
            Property Node(instance in=reference to "1000х", "Disabled"=TRUE)
            Property Node(instance in=reference to "100х", "Disabled"=TRUE)
            Property Node(instance in=reference to "10х", "Disabled"=TRUE)
            Property Node(instance in=reference to "Set Load", "Disabled"=TRUE)
            Property Node(instance in=reference to "1х, Ohm", "Disabled"=TRUE)
            Property Node(instance in=reference to "Total Load, Ohm", "Disabled"=TRUE)
          }
        }
      }
      frame "Set Load" { }
      frame "Calculations/Read Slot Memory" { }
    }
    stop if FALSE
  }
  Obtain Queue(element data type="Buttons WebVI Calc.gtype" "Initialize ", name="Queue 3") -> (queue out=w34)
  Enqueue Element(element="Buttons WebVI Calc.gtype" "Initialize ", queue=w34) -> (queue out=w35)
  while {
    event {
      on "Calc/Slot number" Value changed {
        w36 = "Calculations/Array/Read Slot Memory"  # Buttons WebVI Calc
        Enqueue Element(element=w36, queue=w35)
      }
      on "Calculate P/J" Value changed {
        w37 = "Calculations/Tab 1"  # Buttons WebVI Calc
        Enqueue Element(element=w37, queue=w35)
      }
      on "Clear/Tab 1" Value changed {
        w38 = "Clear/Tab 1"  # Buttons WebVI Calc
        Enqueue Element(element=w38, queue=w35)
      }
    }
    Wait(time to wait=1000)
    stop if FALSE
  }
  while {
    Dequeue Element(queue=w35) -> (element=w39, queue out=w40)
    case (w39) {
      frame "Initialize " {
        Property Node(instance in=reference to "Calc/Slot number", "Value"=0)
        w41 = cluster{"Element 1": f64[], "Element 2": f64[]} {all zero or empty}
        Property Node(instance in=reference to "Graph P", "Value"=w41)
      }
      frame "Calculations/Read Slot Memory" {
        w42 = "Read"  # Memory buffer.Command to buffer
        call "Memory buffer.gvi"(Write/Read/Clear/Number of slot=$"Calc/Slot number", Command to buffer=w42) -> (Slot name indicator=w43, Read/Slot=w44, Save all=w45)
        $"Memory slot" <- w43
        $"Read/Table" <- w44
        $"Read/Slot name" <- w45
      }
      frame "Calculations/Tab 1", Default {
        Array Index(array=$"Read/Table") -> (out0[_, 0]=w46, out1[_, 1]=w47, out2[_, 4]=w48)
        Multiply(w46, w47) -> w49
        Build Cluster(w46, w49) -> w50
        $"Graph P" <- w50
        w51 = 0.07  # Square Solar Panel
        Multiply(w48, w51) -> w52
        Build Array(w49, w52) -> w53
        Transpose 2D Array(2D array=w53) -> (transposed array=w54)
        $"transposed array" <- w54
      }
      frame "Clear/Tab 1" {
        Property Node(instance in=reference to "transposed array", "Value"=f64[][] [])
        w55 = cluster{"Element 1": f64[], "Element 2": f64[]} {all zero or empty}
        Property Node(instance in=reference to "Graph P", "Value"=w55)
      }
      frame "Calculations/Array/Read Slot Memory" { }
    }
    stop if FALSE
  }
