vi "Main.Lab.gviweb"   [LabVIEW NXG 5.0.0]
panel controls:
  "Clear/ Tab 1": bool
  "Isc": f64
  "Uoc": f64
  "Clear Graph Tab 4": bool
  "Save in memory": bool
  "Slot Name": string
  "Slot Number": i32 = "Slot 1"(0)
  "Imp": f64
  "Ump": f64
  "FF/Calculation": bool
  "Add to table Tab 4": bool
  "Calculate Tab 1": bool
  "T1": f64
  "T2": f64
  "Uoc/Calculation_3": f64
  "Uoc2": f64
  "Kt/Calculation": bool
  "Calculate average": bool
  "Parameter Y": i32 = -1
  "Parameter X": i32 = -1
  "Calculation": i32
  "History Graph V/Measurment": i16 = 400
  "History Graph I/Measurment": i16 = 400
  "History Graph T/Measurment": i16 = 400
  "Clear All Memory": bool
  "Clear Table Tab 4": bool
  "Slot number/Read/": i32 = "1"(0)
  "Show Graph Tab 4": bool
  "Clear Memory": bool
  "Slot number Tab 1": i32 = "1"(0)
  "Calc/Slot number2.1": i32 = "1"(0)
  "Show / Hide Graph 1": bool
  "Delete Last Tab 4": bool
  "Change History J/Measurment": i32
  "History Graph R/Measurment": i16 = 400
  "History Graph J/Measurment": i16 = 400
  "Show / Hide Graph 2": bool
  "Calc/Slot number2.2": i32 = "1"(0)
  "Calc/Slot number2.3": i32 = "1"(0)
  "Calc/Slot number2.4": i32 = "1"(0)
  "Show / Hide Graph 3": bool
  "Show / Hide Graph 4": bool
  "Input Data": f64[][] = [[1.814, 0.0233, 27.1, 0, 500, 70], [1.802, 0.069, 26.11, 0, 500, 75], [1.794, 0.109, 16.45, 0, 500, 73], [1.792, 0.151, 11.86, 0, 500, 72], [1.78, 0.192, 9.27, 0, 500, 73], [1.773, 0.231, 7.5, 0, 500, 0], [1.765, 0.273, 6.46, 0, 500, 0], [1.762, 0.315, 5.59, 0, 500, 0], [1.754, 0.358, 4.89, 0, 500, 0], [1.734, 0.399, 4.34, 0, 500, 0], [1.725, 0.439, 3.78, 0, 500, 0], [1.721, 0.48, 3.54, 0, 500, 0], [1.711, 0.521, 3.15, 0, 500, 0], [1.688, 0.561, 3.01, 0, 500, 0], [1.667, 0.602, 2.7, 0, 500, 0], [1.657, 0.636, 2.59, 0, 500, 0], [1.648, 0.678, 2.32, 0, 500, 0], [1.613, 0.718, 2.1, 0, 500, 0], [1.244, 0.761, 1.64, 0, 500, 0], [0.461, 0.793, 0.58, 0, 500, 0], [0.016, 0.798, 0.02, 0, 500, 0]]
  "X": f64
  "Y": f64
  "Set_2": bool
  "Set Load_2": bool
  "Connecting Solar Panels": i32 = -1
  "Set": bool
  "Cooling Conditions": i32 = -1
  "Heating Conditions": i32 = -1
  "Dimming Conditions": i32 = -1
  "Panel angle, º": i32
  "Power setting for the light source, W": i32
  "100х": i32[]
  "10х": i32[]
  "1х, Ohm": i32[]
  "1000х": i32[]
  "Set Load": bool
  "Get": bool
  "Manual/Automatic": enum{"Manual", "Automatic"} = "Manual"
  "error in_6": error
  "Server Url": string = "https://api.systemlinkcloud.com/"
  "API Key": string = "zYUbuW0YNkg1G__lXfJiGVBNWME-HlVd2a5NUHp-IP"
  "error in_7": error
  "error in_3": error
  "Cluster Constant": T2 = {"Array Constant_3"=["Single", "Parallel 2", "Parallel 2 Diode", "Series 2", "Series 2 Diode", "Parallel All", "Parallel All Diode", "Parallel Of Series", "Parallel Of Series Diode", "Series Of Parallel", "Series Of Parallel Diode"], "Array Constant"=[0, 1, 2, 3, 4, 5, 6, 7, 8, 9, 10]}
  "error in_4": error
  "Cluster Constant_2": T2 = {"Array Constant_3"=["Single", "Parallel 2", "Parallel 2 Diode", "Series 2", "Series 2 Diode", "Parallel All", "Parallel All Diode", "Parallel Of Series", "Parallel Of Series Diode", "Series Of Parallel", "Series Of Parallel Diode"], "Array Constant"=[0, 1, 2, 3, 4, 5, 6, 7, 8, 9, 10]}
  "Get Load": bool
  "error in_2": error
  "Server Url _2": string = "https://api.systemlinkcloud.com/"
  "API Key_2": string = "zYUbuW0YNkg1G__lXfJiGVBNWME-HlVd2a5NUHp-IP"
panel indicators:
  "Start/Stop lab": bool
  "Refresh": bool
  "Lab Manual": bool
  "Graph Voltage": f64[]
  "Clear Graph V/Measurment": bool
  "Change history V/Measurment": bool
  "Isc/Calculation": bool
  "Uoc/Calculation": bool
  "Graph Tab 4": cluster{"Element 1": f64[], "Element 2": f64[]}
  "Print Page": bool
  "Slot name": string
  "Imp/Calculation": bool
  "Ump/Calculation": bool
  "FF": f64
  "Graph 1 Tab 3": T1[]
  "Graph 2 Tab 3": cluster{"Element 1": f64[], "Element 2": f64[]}[]
  "T1/Calclation": bool
  "T2/Calculation": bool
  "Uoc1/Calculation": bool
  "Uoc2/Calculation": bool
  "Kt": f64
  "URL Image_2": string
  "URL Image_3": string
  "Graph Current": f64[]
  "Clear Graph I/Measurment": bool
  "Graph Temperature": f64[]
  "Clear Graph T/Measurment": bool
  "Change History I/Measurment": bool
  "Change History T/Measurment": bool
  "URL Image_4": string
  "Memory Slot": string[]
  "Read Slot Name": string
  "URL Image_5": string
  "LED": bool
  "button_38": bool
  "Table/Measurment": f64[][]
  "URL Image_6": string
  "URL Image_7": string
  "Graph Tab 1": T1[]
  "Web Camera": string
  "Delete Last": bool
  "Slot name2.1": string
  "Slot name2.2": string
  "Slot name2.3": string
  "Update Display": string
  "Graph Load": f64[]
  "Clear Graph R/Measurment": bool
  "Change History R/Measurment": bool
  "Graph_10": f64[]
  "Clear Graph J/Measurment": bool
  "Change History J/Measurment_2": bool
  "Table Measurments": f64[][]
  "Headers/Calculation": string[]
  "Slot name2.4": string
  "Headers/Measurment": string[]
  "Table/Avarage": f64[][]
  "Table Tab 4": f64[][]
  "Header XY": string[]
  "Table Tab 4_2": f64[][]
  "Connecting Solar Panel_2": string
  "Connecting Solar Panel_3": string
  "Connecting Solar Panel": string
  "Cooling": string
  "Heating": string
  "Dimming": string
  "Angle": i32
  "Power": i32
  "Total Load, Ohm": i32
  "Load": string
  "appended array": string[]
  "error out_3": error
  "Value_5": string[]
  "error out_5": error
  "appended array_2": string[]
  "Set Led": bool
  "error out_4": error
  "Numeric": f64
  "element": string
  "error out_6": error
  "Numeric_2": f64
  "element_2": string
  "API Key D": string
  "Server Url D": string
  "error out_2": error
  "Temperature, ºC": f64
  "Intensity, W/m2": f64
  "Panel tilt angle, º": f64
  "Angle of rotation, º": f64
  "I, A": f64
  "R,Ohm": f64
  "U, V": f64
  "Graph Voltage_2": f64[]
  "Graph": f64[]
types:
  T1 = cluster{"Element 1": cluster{"Element 1": f64, "Element 2": f64}[]}
  T2 = cluster{"Array Constant_3": string[], "Array Constant": i32[]}
uses:
  WebApp::Support::Message Queue SLC::Obtain Message SLC.gvi
  WebApp::Support::Message Queue SLC::Enqueue Message SLC.gvi
  WebApp::Support::Message Queue SLC::Dequeue Message SLC.gvi
  WebApp::Load Selection::Load selection.gvi
  NI::Skyline::Configuration::Open Configuration API Key.gvi
  NI::Skyline::TagHTTP::Open Tag.gvi
  NI::Skyline::TagHTTP::Write Tag (String).gvi
  NI::Skyline::TagHTTP::Close Tag (Single).gvi
  NI::Skyline::Configuration::Close Configuration.gvi
  NI::Skyline::TagHTTP::Query Tags.gvi
  NI::Skyline::TagHTTP::Read Tag (String).gvi
  NI::Skyline::TagHTTP::Read Tag (DBL).gvi
  WebApp::Support::Message Queue WEB::Create All Message Queues.gvi
  WebApp::Support::Message Queue WEB::Enqueue Message (Single).gvi
  WebApp::Support::Message Queue WEB::Dequeue Message.gvi
  WebApp::Memory Buffer::Memory buffer.gvi
  WebApp::Custom Chart::Custom Chart.gvi
diagram:
  call "Obtain Message SLC.gvi"() -> (queue out=w1, error out=w2)
  call "Enqueue Message SLC.gvi"(message queue in=w1, Buttons SLC="Initialize", error in=w2) -> (message queue out=w3, error out=w4)
  while {
    event {
      on "\"Connecting Solar Panels \"" Value changed {
        call "Enqueue Message SLC.gvi"(message queue in=w3, message="", Buttons SLC="Connecting Solar Panel")
      }
      on "Cooling Conditions" Value changed {
        call "Enqueue Message SLC.gvi"(message queue in=w3, message="", Buttons SLC="Cooling Conditions")
      }
      on "Heating Conditions" Value changed {
        call "Enqueue Message SLC.gvi"(message queue in=w3, message="", Buttons SLC="Heating Conditions")
      }
      on "Dimming Conditions" Value changed {
        call "Enqueue Message SLC.gvi"(message queue in=w3, message="", Buttons SLC="Dimming conditions")
      }
      on "Panel angle, º" Value changed {
        call "Enqueue Message SLC.gvi"(message queue in=w3, message="", Buttons SLC="Tilt angle")
      }
      on "Power setting for the light source, W" Value changed {
        call "Enqueue Message SLC.gvi"(message queue in=w3, message="", Buttons SLC="Power setting")
      }
      on "1000х" Value changed; "100х" Value changed; "10х" Value changed; "1х, Ohm" Value changed {
        call "Enqueue Message SLC.gvi"(message queue in=w3, message="", Buttons SLC="Load ")
      }
      on "Set Load" Value changed {
        call "Enqueue Message SLC.gvi"(message queue in=w3, message="", Buttons SLC="Set Load")
      }
      on "Set" Value changed {
        call "Enqueue Message SLC.gvi"(message queue in=w3, message="", Buttons SLC="Set")
      }
      on "Get" Value changed {
        call "Enqueue Message SLC.gvi"(message queue in=w3, message="", Buttons SLC="Set")
      }
    }
    stop if FALSE
  }
  $"API Key D" <- "zYUbuW0YNkg1G__lXfJiGVBNWME-HlVd2a5NUHp-IP"
  $"Server Url D" <- "https://api.systemlinkcloud.com/"
  while {
    call "Dequeue Message SLC.gvi"(message queue in=w3, error in=w4) -> (message queue out=w5, Message=w6, Buttons SLC=w7)
    case (w7) {
      frame "Initialize", Default { }
      frame "Connecting Solar Panel" {
        w8 = ["Single", "Parallel 2", "Parallel 2 Diode", "Series 2", "Series 2 Diode", "Parallel 4", "Parallel 4 Diode", "Parallel Of Series", "Parallel Of Series Diode", "Series Of Parallel", "Series Of Parallel Diode"]
        Property Node(instance in=reference to "Connecting Solar Panels") -> ("Value"=w9)
        Array Index(array=w8) -> (out0[w9]=w10)
        $"Connecting Solar Panel" <- w10
      }
      frame "Cooling Conditions" {
        w11 = ["Turn All Off", "Turn All On", "Turn 1,2 On", "Turn 3,4 On", "", "", "", "", "", "", ""]
        Property Node(instance in=reference to "Cooling Conditions") -> ("Value"=w12)
        Array Index(array=w11) -> (out0[w12]=w13)
        $Cooling <- w13
      }
      frame "Heating Conditions" {
        w14 = ["None", "Panel 1", "Panel 2", "Panel 3", "Panel 4", "", "", "", "", "", ""]
        Property Node(instance in=reference to "Heating Conditions") -> ("Value"=w15)
        Array Index(array=w14) -> (out0[w15]=w16)
        $Heating <- w16
      }
      frame "Dimming conditions" {
        w17 = ["None", "Filter 1", "Filter 2", "", "", "", "", "", "", "", ""]
        Property Node(instance in=reference to "Dimming Conditions") -> ("Value"=w18)
        Array Index(array=w17) -> (out0[w18]=w19)
        $Dimming <- w19
      }
      frame "Tilt angle" {
        Property Node(instance in=reference to "Panel angle, º") -> ("Value"=w20)
        $Angle <- w20
      }
      frame "Power setting" {
        Property Node(instance in=reference to "Power setting for the light source, W") -> ("Value"=w21)
        $Power <- w21
      }
      frame "Load " {
        case ($"Manual/Automatic") {
          frame "Manual", Default {
            Property Node(instance in=reference to "1000х", "Disabled"=FALSE)
            call "Load selection.gvi"(List box=reference to "1000х", Value=[1000, 2000, 3000]) -> (Sum=w22, Load=w23)
            $Load <- w23
            Property Node(instance in=reference to "100х", "Disabled"=FALSE)
            call "Load selection.gvi"(List box=reference to "100х", Value=[100, 200, 400, 500]) -> (Sum=w24, Load=w25)
            Property Node(instance in=reference to "10х", "Disabled"=FALSE) -> (instance out=w26)
            call "Load selection.gvi"(List box=w26, Value=[10, 20, 40, 50]) -> (Sum=w27, Load=w28)
            call "Load selection.gvi"(List box=reference to "1х, Ohm", Value=[1, 2, 4, 5]) -> (Sum=w29, Load=w30)
            Add(w22, w24, w27, w29) -> w31
            $"Total Load, Ohm" <- w31
            Build Array(w23, w25, w28, w30) -> w32
            $"appended array" <- w32
            Property Node(instance in=reference to "Set Load", "Disabled"=FALSE)
            Property Node(instance in=reference to "1х, Ohm", "Disabled"=FALSE)
            Property Node(instance in=reference to "Total Load, Ohm", "Disabled"=FALSE)
          }
          frame "Automatic" {
            Property Node(instance in=reference to "1000х", "Disabled"=TRUE)
            Property Node(instance in=reference to "100х", "Disabled"=TRUE)
            Property Node(instance in=reference to "10х", "Disabled"=TRUE)
            Property Node(instance in=reference to "Set Load", "Disabled"=TRUE)
            Property Node(instance in=reference to "1х, Ohm", "Disabled"=TRUE)
            Property Node(instance in=reference to "Total Load, Ohm", "Disabled"=TRUE)
          }
        }
      }
      frame "Set Load" {
        call "Open Configuration API Key.gvi"(server url=$"Server Url", api key=$"API Key", error in=$"error in_6") -> (configuration=w33)
        Property Node(instance in=reference to "appended array") -> ("Value"=w34)
        for {
          w35 = each element of ["MV-Load 1", "MV-Load 2", "MV-Load 3", "MV-Load 4"]
          w36 = each element of w34
          call "Open Tag.gvi"(path=w35, data type="String", configuration=w33) -> (tag=w37)
          call "Write Tag (String).gvi"(tag in=w37, value=w36) -> (tag out=w38, error out=w39)
        }
        call "Close Tag (Single).gvi"(tag=w38, error in=w39) -> (error out=w40)
        call "Close Configuration.gvi"(configuration=w33, error in=w40) -> (error out=w41)
        $"error out_3" <- w41
        $Value_5 <- w34
      }
      frame "Set" {
        $"Set Led" <- TRUE
        call "Open Configuration API Key.gvi"(server url=$"Server Url", api key=$"API Key", error in=$"error in_7") -> (configuration=w42)
        w43 = ["MV-Connecting Solar Panels ", "MV-Cooling Conditions", "MV-Heating Conditions", "MV-Dimming Conditions", "MV-Panel Tilt Angle", "MV-Light Source Power", "", "", "", ""]
        Property Node(instance in=reference to "Connecting Solar Panel") -> ("Value"=w44)
        Property Node(instance in=reference to "Cooling") -> ("Value"=w45)
        Property Node(instance in=reference to "Heating") -> ("Value"=w46)
        Property Node(instance in=reference to "Dimming") -> ("Value"=w47)
        Property Node(instance in=reference to "Angle") -> ("Value"=w48)
        Number To Decimal String(number=w48) -> (decimal integer string=w49)
        Property Node(instance in=reference to "Power") -> ("Value"=w50)
        Number To Decimal String(number=w50) -> (decimal integer string=w51)
        Build Array(w44, w45, w46, w47, w49, w51) -> w52
        for {
          w53 = each element of w43
          w54 = each element of w52
          call "Open Tag.gvi"(path=w53, data type="String", configuration=w42) -> (tag=w55)
          call "Write Tag (String).gvi"(tag in=w55, value=w54) -> (tag out=w56, error out=w57)
        }
        call "Close Tag (Single).gvi"(tag=w56, error in=w57) -> (error out=w58)
        call "Close Configuration.gvi"(configuration=w42, error in=w58) -> (error out=w59)
        $"error out_5" <- w59
        $"appended array_2" <- w52
      }
      frame "Get" {
        Property Node(instance in=$"Cluster Constant") -> ("Array Constant_3"=w60)
        Array Index(array=w60)
        Wait(time to wait=200)
        call "Open Configuration API Key.gvi"(server url="https://api.systemlinkcloud.com/", api key="zYUbuW0YNkg1G__lXfJiGVBNWME-HlVd2a5NUHp-IP", error in=$"error in_3") -> (configuration=w61, error out=w62)
        call "Query Tags.gvi"(error in=w62, configuration=w61) -> (tags=w63, error out=w64)
        for {
          w65 = each element of w63
          Property Node(instance in=w65) -> ("Path"=w67, "Datatype"=w68)
          call "Open Tag.gvi"(path=w67, data type=w68, error in=w64, configuration=w61) -> (tag=w69, error out=w70)
          call "Read Tag (String).gvi"(tag in=w69, error in=w70) -> (tag out=w71, value=w72, error out=w73)
          append w72 to w66
        }
        Array Index(array=w66) -> (out0[0]=w74)
        case (w74) {
          frame "Single", Default {
            Property Node(instance in=reference to "Connecting Solar Panels", "Value"=0)
          }
          frame "Parallel 2" {
            Property Node(instance in=reference to "Connecting Solar Panels", "Value"=1)
          }
          frame "Parallel 2 Diode" {
            Property Node(instance in=reference to "Connecting Solar Panels", "Value"=2)
          }
          frame "Series 2" {
            Property Node(instance in=reference to "Connecting Solar Panels", "Value"=3)
          }
          frame "Series 2 Diode" { }
          frame "Parallel All" { }
          frame "Parallel All Diode" { }
          frame "Series All" { }
          frame "Series All Diode" { }
          frame "Parallel Of Series" { }
          frame "Parallel Of Series Diode" { }
          frame "Series Of Parallel" { }
          frame "Series Of Parallel Diode" { }
        }
        $element <- w74
        call "Close Tag (Single).gvi"(tag=w71, error in=w73) -> (error out=w75)
        call "Close Configuration.gvi"(configuration=w61, error in=w75) -> (error out=w76)
        $"error out_4" <- w76
        $Numeric <- 50
      }
      frame 11 {
        Property Node(instance in=$"Cluster Constant_2") -> ("Array Constant_3"=w77)
        Array Index(array=w77)
        Wait(time to wait=200)
        call "Open Configuration API Key.gvi"(server url="https://api.systemlinkcloud.com/", api key="zYUbuW0YNkg1G__lXfJiGVBNWME-HlVd2a5NUHp-IP", error in=$"error in_4") -> (configuration=w78, error out=w79)
        call "Query Tags.gvi"(paths=_, error in=w79, configuration=w78) -> (tags=w80, error out=w81)
        for {
          w82 = each element of w80
          Property Node(instance in=w82) -> ("Path"=w84, "Datatype"=w85)
          call "Open Tag.gvi"(path=w84, data type=w85, error in=w81, configuration=w78) -> (tag=w86, error out=w87)
          call "Read Tag (String).gvi"(tag in=w86, error in=w87) -> (tag out=w88, value=w89, error out=w90)
          append w89 to w83
        }
        Array Index(array=w83) -> (out0[0]=w91)
        case (w91) {
          frame "Single", Default {
            Property Node(instance in=reference to "Connecting Solar Panels", "Value"=0)
          }
          frame "Parallel 2" {
            Property Node(instance in=reference to "Connecting Solar Panels", "Value"=1)
          }
          frame "Parallel 2 Diode" {
            Property Node(instance in=reference to "Connecting Solar Panels", "Value"=2)
          }
          frame "Series 2" {
            Property Node(instance in=reference to "Connecting Solar Panels", "Value"=3)
          }
          frame "Series 2 Diode" { }
          frame "Parallel All" { }
          frame "Parallel All Diode" { }
          frame "Series All" { }
          frame "Series All Diode" { }
          frame "Parallel Of Series" { }
          frame "Parallel Of Series Diode" { }
          frame "Series Of Parallel" { }
          frame "Series Of Parallel Diode" { }
        }
        $element_2 <- w91
        call "Close Tag (Single).gvi"(tag=w88, error in=w90) -> (error out=w92)
        call "Close Configuration.gvi"(configuration=w78, error in=w92) -> (error out=w93)
        $"error out_6" <- w93
        $Numeric_2 <- 50
      }
    }
    stop if FALSE
  }
  while {
    call "Open Configuration API Key.gvi"(server url=$"Server Url _2", api key=$"API Key_2", error in=$"error in_2") -> (configuration=w94, error out=w95)
    w96 = ["PV-Temperature", "PV-Intensity", "PV-Panel Tilt Angle", "PV-Angle Of Rotation", "PV-Current", "PV-Load", "PV-Voltage"]
    call "Query Tags.gvi"(paths=w96, error in=w95, configuration=w94) -> (tags=w97, error out=w98)
    for {
      w99 = each element of w97
      Property Node(instance in=w99) -> ("Path"=w101, "Datatype"=w102)
      call "Open Tag.gvi"(path=w101, data type=w102, error in=w98, configuration=w94) -> (tag=w103, error out=w104)
      call "Read Tag (DBL).gvi"(tag in=w103, error in=w104) -> (tag out=w105, value=w106, error out=w107)
      append w106 to w100
    }
    Array Index(array=w100) -> (out0[0]=w108, out1[1]=w109, out2[2]=w110, out3[3]=w111, out4[4]=w112, out5[5]=w113, out6[6]=w114)
    $"Temperature, ºC" <- w108
    Wait(time to wait=500)
    $"Intensity, W/m2" <- w109
    $"Panel tilt angle, º" <- w110
    $"Angle of rotation, º" <- w111
    $"I, A" <- w112
    $"R,Ohm" <- w113
    $"U, V" <- w114
    call "Close Tag (Single).gvi"(tag=w105, error in=w107) -> (error out=w115)
    call "Close Configuration.gvi"(configuration=w94, error in=w115) -> (error out=w116)
    $"error out_2" <- w116
    stop if FALSE
  }
  call "Create All Message Queues.gvi"() -> (message queue=w117, error out=w118)
  while {
    event {
      on "Save in memory" Value changed {
        call "Enqueue Message (Single).gvi"(message queue in=w117, message="", Buttons WebVI="Measurements/Save in Memory Buffer")
      }
      on "Slot number/Read/" Value changed {
        call "Enqueue Message (Single).gvi"(message queue in=w117, message="", Buttons WebVI="Measurements/Read from Memory Buffer")
      }
      on "Clear Memory" Value changed {
        call "Enqueue Message (Single).gvi"(message queue in=w117, message="", Buttons WebVI="Memory Buffer/Clear")
      }
      on "Clear All Memory" Value changed {
        call "Enqueue Message (Single).gvi"(message queue in=w117, message="", Buttons WebVI="Memory Buffer/Clear all")
      }
      on "Slot number Tab 1" Value changed {
        w119 = "Calculations/Read Slot Memory"  # Buttons WebVI/Measurments
        call "Enqueue Message (Single).gvi"(message queue in=w117, message="", Buttons WebVI=w119)
      }
      on "Calculate Tab 1" Value changed {
        w120 = "Calculation/Tab 1"  # Buttons WebVI/Measurments
        call "Enqueue Message (Single).gvi"(message queue in=w117, message="", Buttons WebVI=w120)
      }
      on "Clear/ Tab 1" Value changed {
        w121 = "Clear/Tab 1"  # Buttons WebVI/Measurments
        call "Enqueue Message (Single).gvi"(message queue in=w117, message="", Buttons WebVI=w121)
      }
      on "Calc/Slot number2.1" Value changed; "Calc/Slot number2.2" Value changed; "Calc/Slot number2.3" Value changed; "Calc/Slot number2.4" Value changed; "Show / Hide Graph 1" Value changed; "Show / Hide Graph 2" Value changed; "Show / Hide Graph 3" Value changed; "Show / Hide Graph 4" Value changed {
        w122 = "Calculation/Tab 2"  # Buttons WebVI/Measurments
        call "Enqueue Message (Single).gvi"(message queue in=w117, message="", Buttons WebVI=w122)
      }
      on "Add to table Tab 4" Value changed {
        call "Enqueue Message (Single).gvi"(message queue in=w117, message="", Buttons WebVI="Create Table/Tab 3")
      }
      on "Clear Table Tab 4" Value changed {
        call "Enqueue Message (Single).gvi"(message queue in=w117, message="", Buttons WebVI="Clear Table/Tab 3")
      }
      on "Delete Last Tab 4" Value changed {
        call "Enqueue Message (Single).gvi"(message queue in=w117, message="", Buttons WebVI="Delete Last Table/Tab 3")
      }
      on "Show Graph Tab 4" Value changed {
        call "Enqueue Message (Single).gvi"(message queue in=w117, message="", Buttons WebVI="Show Chart")
      }
      on "Clear Graph Tab 4" Value changed {
        call "Enqueue Message (Single).gvi"(message queue in=w117, message="", Buttons WebVI="Clear Chart")
      }
      on "Parameter X" Value changed; "Parameter Y" Value changed {
        call "Enqueue Message (Single).gvi"(message queue in=w117, message="", Buttons WebVI="Header Tab 3")
      }
    }
    stop if FALSE
  }
  while {
    call "Dequeue Message.gvi"(message queue in=w117, error in=w118) -> (message queue out=w123, message=w124, Buttons WebVI=w125)
    case (w125) {
      frame "Initialize ", Default {
        call "Memory buffer.gvi"(Initialize/Max Number of slots memory=10, Command to buffer="Initialize") -> (Slot name indicator=w126)
        $"Memory Slot" <- w126
        w127 = "Initialize"  # Command Chart
        call "Custom Chart.gvi"(Command Graph=w127, X=0, Y=0) -> (Table out=w128, Chart=w129)
        $"Table Tab 4" <- w128
        Property Node(instance in=reference to "Slot number Tab 1", "Value"=10)
        $"Graph Tab 4" <- w129
        Property Node(instance in=reference to "Table/Measurment", "Value"=f64[][] [])
        Property Node(instance in=reference to "Slot name", "Value"="")
        Property Node(instance in=reference to "Graph Tab 1", "Value"=T1[] [])
        w130 = ["U, V", "I, A", "R, Ohm", "Angle, º", "J, W / m²", "T, ºC", "P,W", "ɳ,%"]
        $"Headers/Measurment" <- w130
        $"Headers/Calculation" <- w130
        Property Node(instance in=reference to "Table Measurments", "Value"=f64[][] [])
        call "Enqueue Message (Single).gvi"(message queue in=w123, message="Initialize", Buttons WebVI="Update Display")
      }
      frame "Measurements/Save in Memory Buffer" {
        call "Memory buffer.gvi"(Number of slot=$"Slot Number", Command to buffer="Read") -> (Read/Slot=w131)
        Property Node(instance in=w131, "Slot name"=$"Slot Name", "Measurements"=$"Input Data") -> (instance out=w132)
        w133 = "Write"  # Command
        call "Memory buffer.gvi"(Buffer Data=w132, Number of slot=$"Slot Number", Command to buffer=w133) -> (Slot name indicator=w134, Read/Slot=w135)
        $"Memory Slot" <- w134
        Property Node(instance in=w135) -> ("Measurements"=w136)
        $"Table/Measurment" <- w136
        call "Enqueue Message (Single).gvi"(message queue in=w123, message="Data recording", Buttons WebVI="Update Display")
      }
      frame "Measurements/Read from Memory Buffer" {
        w137 = "Read"  # Command
        call "Memory buffer.gvi"(Number of slot=$"Slot number/Read/", Command to buffer=w137) -> (Slot name indicator=w138, Read/Slot=w139)
        $"Memory Slot" <- w138
        Property Node(instance in=w139) -> ("Slot name"=w140, "Measurements"=w141)
        $"Read Slot Name" <- w140
        $"Table/Measurment" <- w141
        call "Enqueue Message (Single).gvi"(message queue in=w123, message="Reading From Memory Buffer", Buttons WebVI="Update Display")
      }
      frame "Memory Buffer/Clear" {
        w142 = "Clear"  # Command
        call "Memory buffer.gvi"(Number of slot=$"Slot number/Read/", Command to buffer=w142) -> (Slot name indicator=w143, Read/Slot=w144)
        $"Memory Slot" <- w143
        Property Node(instance in=w144) -> ("Slot name"=w145, "Measurements"=w146)
        $"Read Slot Name" <- w145
        $"Table/Measurment" <- w146
        call "Enqueue Message (Single).gvi"(message queue in=w123, message="Deleting memory", Buttons WebVI="Update Display")
      }
      frame "Memory Buffer/Clear all" {
        w147 = "Clear all"  # Command
        call "Memory buffer.gvi"(Number of slot=$"Slot number/Read/", Command to buffer=w147) -> (Slot name indicator=w148, Read/Slot=w149)
        $"Memory Slot" <- w148
        Property Node(instance in=w149) -> ("Slot name"=w150, "Measurements"=w151)
        $"Read Slot Name" <- w150
        $"Table/Measurment" <- w151
        call "Enqueue Message (Single).gvi"(message queue in=w123, message="Deleting all memory", Buttons WebVI="Update Display")
      }
      frame "Load Selection" {
        call "Enqueue Message (Single).gvi"(message queue in=w123, message="Load selection", Buttons WebVI="Update Display")
      }
      frame "Set Load" { }
      frame "Calculations/Read Slot Memory" {
        w152 = "Read"  # Command
        call "Memory buffer.gvi"(Number of slot=$"Slot number Tab 1", Command to buffer=w152) -> (Read/Slot=w153)
        Property Node(instance in=w153) -> ("Slot name"=w154, "Measurements"=w155)
        $"Slot name" <- w154
        $"Table Measurments" <- w155
        call "Enqueue Message (Single).gvi"(message queue in=w123, message="Buffer memory-Tab1", Buttons WebVI="Update Display")
      }
      frame "Calculation/Tab 1" {
        w156 = "Read"  # Command
        call "Memory buffer.gvi"(Number of slot=$"Slot number Tab 1", Command to buffer=w156) -> (Read/Slot=w157)
        Property Node(instance in=w157) -> ("Measurements"=w158)
        Array Index(array=w158) -> (out0[_, 0]=w159, out1[_, 1]=w160, out2[_, 4]=w161)
        Build Index And Bundle Cluster Array(w159, w160) -> (out=w162)
        Multiply(w159, w160) -> w163
        Build Index And Bundle Cluster Array(w159, w163) -> (out=w164)
        Build Cluster Array(w162, w164) -> (out=w165)
        $"Graph Tab 1" <- w165
        w166 = "Write"  # Command
        w167 = "Read"  # Command
        call "Memory buffer.gvi"(Number of slot=$"Slot number Tab 1", Command to buffer=w167) -> (Read/Slot=w168)
        w169 = 0.025  # Square Solar Panel
        Multiply(w161, w169) -> w170
        Divide(x=w163, y=w170) -> w171
        Multiply(w171, 100) -> w172
        Build Array(w163, w172) -> w173
        Transpose 2D Array(2D array=w173) -> (transposed array=w174)
        Property Node(instance in=w168, "Calculations "=w174) -> (instance out=w175)
        call "Memory buffer.gvi"(Buffer Data=w175, Number of slot=$"Slot number Tab 1", Command to buffer=w166) -> (Read/Slot=w176)
        call "Memory buffer.gvi"(Buffer Data=w176, Number of slot=$"Slot number Tab 1", Command to buffer="Read") -> (Read/Slot=w177)
        Property Node(instance in=w177) -> ("Measurements"=w178, "Calculations "=w179)
        Insert Into Array(inArray=w178, index1=6, new=w179) -> w180
        $"Table Measurments" <- w180
        call "Enqueue Message (Single).gvi"(message queue in=w123, message="Calculate Tab 1", Buttons WebVI="Update Display")
      }
      frame "Clear/Tab 1" {
        Property Node(instance in=reference to "Graph Tab 1", "Value"=T1[] [])
        Property Node(instance in=reference to "Table Measurments", "Value"=f64[][] [])
        call "Enqueue Message (Single).gvi"(message queue in=w123, message="Clear Graph Tab 1", Buttons WebVI="Update Display")
      }
      frame "Calculation/Tab 2" {
        Build Array($"Calc/Slot number2.1", $"Calc/Slot number2.2", $"Calc/Slot number2.3", $"Calc/Slot number2.4") -> w181
        Build Array($"Show / Hide Graph 1", $"Show / Hide Graph 2", $"Show / Hide Graph 3", $"Show / Hide Graph 4") -> w182
        for {
          w183 = each element of w182
          w184 = each element of w181
          case (w183) {
            frame False, Default {
              w191 = cluster{"Element 1": f64[], "Element 2": f64[]} {all zero or empty}
              w188 = default
              w189 = T1[] []
              w190 = w191
            }
            frame True {
              w192 = "Read"  # Command
              call "Memory buffer.gvi"(Number of slot=w184, Command to buffer=w192) -> (Read/Slot=w193)
              Property Node(instance in=w193) -> (instance out=w194)
              Property Node(instance in=w194) -> ("Measurements"=w195, "Calculations "=w196, "Slot name"=w188)
              Array Index(array=w195) -> (out0[_, 0]=w197, out1[_, 1]=w198, out2[_, 2]=w199)
              Build Index And Bundle Cluster Array(w197, w198) -> (out=w200)
              Array Index(array=w196) -> (out0[_, 0]=w201, out1[_, 1]=w202)
              Build Index And Bundle Cluster Array(w197, w201) -> (out=w203)
              Build Cluster Array(w200, w203) -> (out=w189)
              Build Cluster(w199, w202) -> w190
            }
          }
          append w188 to w185
          concatenate w189 onto w186
          append w190 to w187
        }
        $"Graph 1 Tab 3" <- w186
        Array Index(array=w185) -> (out0[_]=w204, out1[_]=w205, out2[_]=w206, out3[_]=w207)
        $"Slot name2.1" <- w204
        $"Slot name2.2" <- w205
        $"Slot name2.3" <- w206
        $"Slot name2.4" <- w207
        $"Graph 2 Tab 3" <- w187
        call "Enqueue Message (Single).gvi"(message queue in=w123, message="Calculation Tab 2", Buttons WebVI="Update Display")
      }
      frame "Header Tab 3" {
        Property Node(instance in=reference to "Parameter X") -> ("Items"=w208, "Value"=w209)
        Array Index(array=w208) -> (out0[w209]=w210)
        Property Node(instance in=reference to "Parameter Y") -> ("Items"=w211, "Value"=w212)
        Array Index(array=w211) -> (out0[w212]=w213)
        Build Array(w210, w213) -> w214
        $"Header XY" <- w214
      }
      frame "Create Table/Tab 3" {
        w215 = "Write/Read "  # Command Chart
        call "Custom Chart.gvi"(Command Graph=w215, X=$X, Y=$Y) -> (Table out=w216)
        $"Table Tab 4" <- w216
        call "Enqueue Message (Single).gvi"(message queue in=w123, message="Crate Table Tab 3", Buttons WebVI="Update Display")
      }
      frame "Clear Table/Tab 3" {
        w217 = "Clear Table"  # Command Chart
        call "Custom Chart.gvi"(Command Graph=w217, X=$X, Y=$Y) -> (Table out=w218)
        $"Table Tab 4_2" <- w218
      }
      frame "Delete Last Table/Tab 3" {
        w219 = "Delete last"  # Command Chart
        call "Custom Chart.gvi"(Command Graph=w219, X=$X, Y=$Y) -> (Table out=w220)
        $"Table Tab 4" <- w220
      }
      frame "Show Chart" {
        call "Custom Chart.gvi"(Command Graph="Graph", X=$X, Y=$Y) -> (Chart=w221)
        $"Graph Tab 4" <- w221
      }
      frame "Clear Chart" {
        w222 = "Clear Chart"  # Command Chart
        call "Custom Chart.gvi"(Command Graph=w222, X=$X, Y=$Y) -> (Chart=w223)
        $"Graph Tab 4" <- w223
      }
      frame "Update Display" {
        $"Update Display" <- w124
      }
    }
    stop if FALSE
  }
