vi "Main.Lab1.gviweb"   [LabVIEW NXG 5.0.0]
panel controls:
  "Connecting Solar Panels": i32 = -1
  "Panel angle, º": i32
  "Power setting for the light source, W": i32
  "Cooling Conditions": i32 = -1
  "Clear/ Tab 1": bool
  "Isc": f64
  "Uoc": f64
  "Clear Graph Tab 4": bool
  "Save in memory": bool
  "Slot Name": string
  "Slot Number": i32 = "Slot 1"(0)
  "Imp": f64
  "Ump": f64
  "FF/Calculation": bool
  "Add to table Tab 4": bool
  "Calculate Tab 1": bool
  "T1": f64
  "T2": f64
  "Uoc/Calculation_3": f64
  "Uoc2": f64
  "Kt/Calculation": bool
  "Dimming Conditions": i32 = -1
  "Heating Conditions": i32 = -1
  "1х, Ohm": i32[]
  "10х": i32[]
  "100х": i32[]
  "Set Load": bool
  "Calculate average": bool
  "Parameter Y": i32 = -1
  "Parameter X": i32 = -1
  "Calculation": i32
  "1000х": i32[]
  "History Graph V/Measurment": i16 = 400
  "History Graph I/Measurment": i16 = 400
  "History Graph T/Measurment": i16 = 400
  "Clear All Memory": bool
  "Clear Table Tab 4": bool
  "Slot number/Read/": i32 = "1"(0)
  "Manual/Automatic": enum{"Manual", "Automatic"} = "Manual"
  "Show Graph Tab 4": bool
  "Clear Memory": bool
  "Slot number Tab 1": i32 = "1"(0)
  "Calc/Slot number2.1": i32 = "1"(0)
  "Show / Hide Graph 1": bool
  "Delete Last Tab 4": bool
  "Change History J/Measurment": i32
  "History Graph R/Measurment": i16 = 400
  "History Graph J/Measurment": i16 = 400
  "Show / Hide Graph 2": bool
  "Calc/Slot number2.2": i32 = "1"(0)
  "Calc/Slot number2.3": i32 = "1"(0)
  "Calc/Slot number2.4": i32 = "1"(0)
  "Show / Hide Graph 3": bool
  "Show / Hide Graph 4": bool
  "Input Data": f64[][] = [[1.814, 0.0233, 27.1, 0, 500, 70], [1.802, 0.069, 26.11, 0, 500, 75], [1.794, 0.109, 16.45, 0, 500, 73], [1.792, 0.151, 11.86, 0, 500, 72], [1.78, 0.192, 9.27, 0, 500, 73], [1.773, 0.231, 7.5, 0, 500, 0], [1.765, 0.273, 6.46, 0, 500, 0], [1.762, 0.315, 5.59, 0, 500, 0], [1.754, 0.358, 4.89, 0, 500, 0], [1.734, 0.399, 4.34, 0, 500, 0], [1.725, 0.439, 3.78, 0, 500, 0], [1.721, 0.48, 3.54, 0, 500, 0], [1.711, 0.521, 3.15, 0, 500, 0], [1.688, 0.561, 3.01, 0, 500, 0], [1.667, 0.602, 2.7, 0, 500, 0], [1.657, 0.636, 2.59, 0, 500, 0], [1.648, 0.678, 2.32, 0, 500, 0], [1.613, 0.718, 2.1, 0, 500, 0], [1.244, 0.761, 1.64, 0, 500, 0], [0.461, 0.793, 0.58, 0, 500, 0], [0.016, 0.798, 0.02, 0, 500, 0]]
  "X": f64
  "Y": f64
  "error in_2": error
  "error in_6": error
  "Set": bool
  "error in_7": error
  "Get": bool
  "Get Load": bool
  "error in_3": error
  "Cluster Constant": T2 = {"Array Constant_3"=["Single", "Parallel 2", "Parallel 2 Diode", "Series 2", "Series 2 Diode", "Parallel All", "Parallel All Diode", "Parallel Of Series", "Parallel Of Series Diode", "Series Of Parallel", "Series Of Parallel Diode"], "Array Constant"=[0, 1, 2, 3, 4, 5, 6, 7, 8, 9, 10]}
  "API Key": string = "zYUbuW0YNkg1G__lXfJiGVBNWME-HlVd2a5NUHp-IP"
  "Server Url": string = "https://api.systemlinkcloud.com/"
panel indicators:
  "Start/Stop lab": bool
  "Refresh": bool
  "Lab Manual": bool
  "Graph Voltage": f64[]
  "Clear Graph V/Measurment": bool
  "Change history V/Measurment": bool
  "Isc/Calculation": bool
  "Uoc/Calculation": bool
  "Graph Tab 4": cluster{"Element 1": f64[], "Element 2": f64[]}
  "Print Page": bool
  "Slot name": string
  "Imp/Calculation": bool
  "Ump/Calculation": bool
  "FF": f64
  "Graph 1 Tab 3": T1[]
  "Graph 2 Tab 3": cluster{"Element 1": f64[], "Element 2": f64[]}[]
  "T1/Calclation": bool
  "T2/Calculation": bool
  "Uoc1/Calculation": bool
  "Uoc2/Calculation": bool
  "Kt": f64
  "Total Load, Ohm": i32
  "URL Image_2": string
  "URL Image_3": string
  "Graph Current": f64[]
  "Clear Graph I/Measurment": bool
  "Graph Temperature": f64[]
  "Clear Graph T/Measurment": bool
  "Change History I/Measurment": bool
  "Change History T/Measurment": bool
  "URL Image_4": string
  "Memory Slot": string[]
  "Read Slot Name": string
  "URL Image_5": string
  "LED": bool
  "button_38": bool
  "Table/Measurment": f64[][]
  "URL Image_6": string
  "URL Image_7": string
  "Graph Tab 1": T1[]
  "Web Camera": string
  "Temperature, ºC": f64
  "Delete Last": bool
  "Slot name2.1": string
  "Slot name2.2": string
  "Slot name2.3": string
  "Update Display": string
  "Graph Load": f64[]
  "Clear Graph R/Measurment": bool
  "Change History R/Measurment": bool
  "Graph_10": f64[]
  "Clear Graph J/Measurment": bool
  "Change History J/Measurment_2": bool
  "Table Measurments": f64[][]
  "Headers/Calculation": string[]
  "Slot name2.4": string
  "Headers/Measurment": string[]
  "Intensity, W/m2": f64
  "Panel tilt angle, º": f64
  "Angle of rotation, º": f64
  "Table/Avarage": f64[][]
  "Table Tab 4": f64[][]
  "Header XY": string[]
  "Table Tab 4_2": f64[][]
  "error out_2": error
  "error out_3": error
  "Connecting Solar Panel": string
  "Cooling": string
  "Heating": string
  "Dimming": string
  "Angle": i32
  "Power": i32
  "Load": string
  "appended array": string[]
  "Value_5": string[]
  "error out_5": error
  "appended array_2": string[]
  "I, A": f64
  "R,Ohm": f64
  "U, V": f64
  "Connecting Solar Panel_2": string
  "Connecting Solar Panel_3": string
  "error out_4": error
  "Graph": f64[]
  "Set Led": bool
  "LED_3": bool
  "API Key D": string
  "Server Url D": string
  "Numeric": f64
types:
  T1 = cluster{"Element 1": cluster{"Element 1": f64, "Element 2": f64}[]}
  T2 = cluster{"Array Constant_3": string[], "Array Constant": i32[]}
uses:
  WebApp::Support::Message Queue SLC::Obtain Message SLC.gvi
  WebApp::Support::Message Queue SLC::Enqueue Message SLC.gvi
  WebApp::Support::Message Queue SLC::Dequeue Message SLC.gvi
  WebApp::Load Selection::Load selection.gvi
  NI::Skyline::Configuration::Open Configuration API Key.gvi
  NI::Skyline::TagHTTP::Open Tag.gvi
  NI::Skyline::TagHTTP::Write Tag (String).gvi
  NI::Skyline::TagHTTP::Close Tag (Single).gvi
  NI::Skyline::Configuration::Close Configuration.gvi
  NI::Skyline::TagHTTP::Query Tags.gvi
  NI::Skyline::TagHTTP::Read Tag (String).gvi
  NI::Skyline::TagHTTP::Read Tag (DBL).gvi
  WebApp::Support::Message Queue WEB::Create All Message Queues.gvi
  WebApp::Support::Message Queue WEB::Enqueue Message (Single).gvi
  WebApp::Support::Message Queue WEB::Dequeue Message.gvi
  WebApp::Memory Buffer::Memory buffer.gvi
  WebApp::Custom Chart::Custom Chart.gvi
diagram:
  call "Obtain Message SLC.gvi"() -> (queue out=w1, error out=w2)
  call "Enqueue Message SLC.gvi"(message queue in=w1, Buttons SLC="Initialize", error in=w2) -> (message queue out=w3, error out=w4)
  while {
    event {
      on "Connecting Solar Panels" Value changed {
        call "Enqueue Message SLC.gvi"(message queue in=w3, message="", Buttons SLC="Connecting Solar Panel")
      }
      on "Cooling Conditions" Value changed {
        call "Enqueue Message SLC.gvi"(message queue in=w3, message="", Buttons SLC="Cooling Conditions")
      }
      on "Heating Conditions" Value changed {
        call "Enqueue Message SLC.gvi"(message queue in=w3, message="", Buttons SLC="Heating Conditions")
      }
      on "Dimming Conditions" Value changed {
        call "Enqueue Message SLC.gvi"(message queue in=w3, message="", Buttons SLC="Dimming conditions")
      }
      on "Panel angle, º" Value changed {
        call "Enqueue Message SLC.gvi"(message queue in=w3, message="", Buttons SLC="Tilt angle")
      }
      on "Power setting for the light source, W" Value changed {
        call "Enqueue Message SLC.gvi"(message queue in=w3, message="", Buttons SLC="Power setting")
      }
      on "1000х" Value changed; "100х" Value changed; "10х" Value changed; "1х, Ohm" Value changed {
        call "Enqueue Message SLC.gvi"(message queue in=w3, message="", Buttons SLC="Load ")
      }
      on "Set Load" Value changed {
        call "Enqueue Message SLC.gvi"(message queue in=w3, message="", Buttons SLC="Set Load")
      }
      on "Set" Value changed {
        call "Enqueue Message SLC.gvi"(message queue in=w3, message="", Buttons SLC="Set")
      }
      on "Get" Value changed {
        call "Enqueue Message SLC.gvi"(message queue in=w3, message="", Buttons SLC="Get")
      }
    }
    stop if FALSE
  }
  $"API Key D" <- "zYUbuW0YNkg1G__lXfJiGVBNWME-HlVd2a5NUHp-IP"
  $"Server Url D" <- "https://api.systemlinkcloud.com/"
  while {
    call "Dequeue Message SLC.gvi"(queue in=w3, error in=w4) -> (queue out=w5, Buttons SLC=w6)
    case (w6) {
      frame "Initialize", Default { }
      frame "Connecting Solar Panel" {
        w7 = ["Single", "Parallel 2", "Parallel 2 Diode", "Series 2", "Series 2 Diode", "Parallel 4", "Parallel 4 Diode", "Parallel Of Series", "Parallel Of Series Diode", "Series Of Parallel", "Series Of Parallel Diode"]
        Property Node(instance in=reference to "Connecting Solar Panels") -> ("Value"=w8)
        Array Index(array=w7) -> (out0[w8]=w9)
        $"Connecting Solar Panel" <- w9
      }
      frame "Cooling Conditions" {
        w10 = ["Turn All Off", "Turn All On", "Turn 1,2 On", "Turn 3,4 On", "", "", "", "", "", "", ""]
        Property Node(instance in=reference to "Cooling Conditions") -> ("Value"=w11)
        Array Index(array=w10) -> (out0[w11]=w12)
        $Cooling <- w12
      }
      frame "Heating Conditions" {
        w13 = ["None", "Panel 1", "Panel 2", "Panel 3", "Panel 4", "", "", "", "", "", ""]
        Property Node(instance in=reference to "Heating Conditions") -> ("Value"=w14)
        Array Index(array=w13) -> (out0[w14]=w15)
        $Heating <- w15
      }
      frame "Dimming conditions" {
        w16 = ["None", "Filter 1", "Filter 2", "", "", "", "", "", "", "", ""]
        Property Node(instance in=reference to "Dimming Conditions") -> ("Value"=w17)
        Array Index(array=w16) -> (out0[w17]=w18)
        $Dimming <- w18
      }
      frame "Tilt angle" {
        Property Node(instance in=reference to "Panel angle, º") -> ("Value"=w19)
        $Angle <- w19
      }
      frame "Power setting" {
        Property Node(instance in=reference to "Power setting for the light source, W") -> ("Value"=w20)
        $Power <- w20
      }
      frame "Load " {
        case ($"Manual/Automatic") {
          frame "Manual", Default {
            Property Node(instance in=reference to "1000х", "Disabled"=FALSE)
            call "Load selection.gvi"(List box=reference to "1000х", Value=[1000, 2000, 3000]) -> (Sum=w21, Load=w22)
            $Load <- w22
            Property Node(instance in=reference to "100х", "Disabled"=FALSE)
            call "Load selection.gvi"(List box=reference to "100х", Value=[100, 200, 400, 500]) -> (Sum=w23, Load=w24)
            Property Node(instance in=reference to "10х", "Disabled"=FALSE) -> (instance out=w25)
            call "Load selection.gvi"(List box=w25, Value=[10, 20, 40, 50]) -> (Sum=w26, Load=w27)
            call "Load selection.gvi"(List box=reference to "1х, Ohm", Value=[1, 2, 4, 5]) -> (Sum=w28, Load=w29)
            Add(w21, w23, w26, w28) -> w30
            $"Total Load, Ohm" <- w30
            Build Array(w22, w24, w27, w29) -> w31
            $"appended array" <- w31
            Property Node(instance in=reference to "Set Load", "Disabled"=FALSE)
            Property Node(instance in=reference to "1х, Ohm", "Disabled"=FALSE)
            Property Node(instance in=reference to "Total Load, Ohm", "Disabled"=FALSE)
          }
          frame "Automatic" {
            Property Node(instance in=reference to "1000х", "Disabled"=TRUE)
            Property Node(instance in=reference to "100х", "Disabled"=TRUE)
            Property Node(instance in=reference to "10х", "Disabled"=TRUE)
            Property Node(instance in=reference to "Set Load", "Disabled"=TRUE)
            Property Node(instance in=reference to "1х, Ohm", "Disabled"=TRUE)
            Property Node(instance in=reference to "Total Load, Ohm", "Disabled"=TRUE)
          }
        }
      }
      frame "Set Load" {
        call "Open Configuration API Key.gvi"(server url=$"Server Url", api key=$"API Key", error in=$"error in_6") -> (configuration=w32)
        Property Node(instance in=reference to "appended array") -> ("Value"=w33)
        for {
          w34 = each element of ["MV-Load 1", "MV-Load 2", "MV-Load 3", "MV-Load 4"]
          w35 = each element of w33
          call "Open Tag.gvi"(path=w34, data type="String", configuration=w32) -> (tag=w36)
          call "Write Tag (String).gvi"(tag in=w36, value=w35) -> (tag out=w37, error out=w38)
        }
        call "Close Tag (Single).gvi"(tag=w37, error in=w38) -> (error out=w39)
        call "Close Configuration.gvi"(configuration=w32, error in=w39) -> (error out=w40)
        $"error out_3" <- w40
        $Value_5 <- w33
      }
      frame "Set" {
        $"Set Led" <- TRUE
        call "Open Configuration API Key.gvi"(server url=$"Server Url", api key=$"API Key", error in=$"error in_7") -> (configuration=w41)
        w42 = ["MV-Connecting Solar Panels ", "MV-Cooling Conditions", "MV-Heating Conditions", "MV-Dimming Conditions", "MV-Panel Tilt Angle", "MV-Light Source Power", "", "", "", ""]
        Property Node(instance in=reference to "Connecting Solar Panel") -> ("Value"=w43)
        Property Node(instance in=reference to "Cooling") -> ("Value"=w44)
        Property Node(instance in=reference to "Heating") -> ("Value"=w45)
        Property Node(instance in=reference to "Dimming") -> ("Value"=w46)
        Property Node(instance in=reference to "Angle") -> ("Value"=w47)
        Number To Decimal String(number=w47) -> (decimal integer string=w48)
        Property Node(instance in=reference to "Power") -> ("Value"=w49)
        Number To Decimal String(number=w49) -> (decimal integer string=w50)
        Build Array(w43, w44, w45, w46, w48, w50) -> w51
        for {
          w52 = each element of w42
          w53 = each element of w51
          call "Open Tag.gvi"(path=w52, data type="String", configuration=w41) -> (tag=w54)
          call "Write Tag (String).gvi"(tag in=w54, value=w53) -> (tag out=w55, error out=w56)
        }
        call "Close Tag (Single).gvi"(tag=w55, error in=w56) -> (error out=w57)
        call "Close Configuration.gvi"(configuration=w41, error in=w57) -> (error out=w58)
        $"error out_5" <- w58
        $"appended array_2" <- w51
      }
      frame "Get" {
        call "Open Configuration API Key.gvi"(server url=$"Server Url", api key=$"API Key", error in=$"error in_3") -> (configuration=w59, error out=w60)
        w61 = ["PV-Connecting Solar Panels ", "PV-Cooling Conditions", "PV-Heating Conditions", "PV-Dimming Conditions", "PV-Panel Tilt Angle", "PV-Light Source Power", "", "", "", ""]
        call "Query Tags.gvi"(paths=w61, error in=w60, configuration=w59) -> (tags=w62, error out=w63)
        for {
          w64 = each element of w62
          Property Node(instance in=w64) -> ("Path"=w66, "Datatype"=w67)
          call "Open Tag.gvi"(path=w66, data type=w67, error in=w63, configuration=w59) -> (tag=w68, error out=w69)
          call "Read Tag (String).gvi"(tag in=w68, error in=w69) -> (tag out=w70, value=w71, error out=w72)
          append w71 to w65
        }
        Array Index(array=w65) -> (out0[0]=w73, out1[1]=w74, out2[2]=w75, out3[3]=w76)
        case (w73) {
          frame "Single", Default {
            Property Node(instance in=reference to "Connecting Solar Panels", "Value"=0)
          }
          frame "Parallel 2" {
            Property Node(instance in=reference to "Connecting Solar Panels", "Value"=1)
          }
          frame "Parallel 2 Diode" {
            Property Node(instance in=reference to "Connecting Solar Panels", "Value"=2)
          }
          frame "Series 2" {
            Property Node(instance in=reference to "Connecting Solar Panels", "Value"=3)
          }
          frame "Series 2 Diode" {
            Property Node(instance in=reference to "Connecting Solar Panels", "Value"=4)
          }
          frame "Parallel 4" {
            Property Node(instance in=reference to "Connecting Solar Panels", "Value"=5)
          }
          frame "Parallel 4 Diode" {
            Property Node(instance in=reference to "Connecting Solar Panels", "Value"=6)
          }
          frame "Series 4" {
            Property Node(instance in=reference to "Connecting Solar Panels", "Value"=7)
          }
          frame "Series All Diode" {
            Property Node(instance in=reference to "Connecting Solar Panels", "Value"=8)
          }
          frame "Parallel Of Series" {
            Property Node(instance in=reference to "Connecting Solar Panels", "Value"=9)
          }
          frame "Parallel Of Series Diode" {
            Property Node(instance in=reference to "Connecting Solar Panels", "Value"=10)
          }
          frame "Series Of Parallel" {
            Property Node(instance in=reference to "Connecting Solar Panels", "Value"=11)
          }
          frame "Series Of Parallel Diode" {
            Property Node(instance in=reference to "Connecting Solar Panels", "Value"=12)
          }
        }
        Property Node(instance in=$"Cluster Constant") -> ("Array Constant_3"=w77)
        Array Index(array=w77)
        case (w74) {
          frame "Turn All Off", Default {
            Property Node(instance in=reference to "Cooling Conditions", "Value"=0)
          }
          frame "Turn All On" {
            Property Node(instance in=reference to "Cooling Conditions", "Value"=1)
          }
          frame "Turn 1,2 On" {
            Property Node(instance in=reference to "Cooling Conditions", "Value"=2)
          }
          frame "Turn 3,4 On" {
            Property Node(instance in=reference to "Cooling Conditions", "Value"=3)
          }
        }
        case (w75) {
          frame "None", Default {
            Property Node(instance in=reference to "Heating Conditions", "Value"=0)
          }
          frame "Panel 1" {
            Property Node(instance in=reference to "Heating Conditions", "Value"=1)
          }
          frame "Panel 2" {
            Property Node(instance in=reference to "Heating Conditions", "Value"=2)
          }
          frame "Panel 3" {
            Property Node(instance in=reference to "Heating Conditions", "Value"=3)
          }
          frame "Panel 4" {
            Property Node(instance in=reference to "Heating Conditions", "Value"=4)
          }
        }
        case (w76) {
          frame "None", Default {
            Property Node(instance in=reference to "Dimming Conditions", "Value"=0)
          }
          frame "Filter 1" {
            Property Node(instance in=reference to "Dimming Conditions", "Value"=1)
          }
          frame "Filter 2" {
            Property Node(instance in=reference to "Dimming Conditions", "Value"=2)
          }
        }
        $Numeric <- 500
        call "Close Tag (Single).gvi"(tag=w70, error in=w72) -> (error out=w78)
        call "Close Configuration.gvi"(configuration=w59, error in=w78) -> (error out=w79)
        $"error out_4" <- w79
      }
      frame "Get Load" { }
    }
    stop if FALSE
  }
  while {
    call "Open Configuration API Key.gvi"(server url=$"Server Url", api key=$"API Key", error in=$"error in_2") -> (configuration=w80, error out=w81)
    w82 = ["PV-Temperature", "PV-Intensity", "PV-Panel Tilt Angle", "PV-Angle Of Rotation", "PV-Current", "PV-Load", "PV-Voltage"]
    call "Query Tags.gvi"(paths=w82, error in=w81, configuration=w80) -> (tags=w83, error out=w84)
    for {
      w85 = each element of w83
      Property Node(instance in=w85) -> ("Path"=w87, "Datatype"=w88)
      call "Open Tag.gvi"(path=w87, data type=w88, error in=w84, configuration=w80) -> (tag=w89, error out=w90)
      call "Read Tag (DBL).gvi"(tag in=w89, error in=w90) -> (tag out=w91, value=w92, error out=w93)
      append w92 to w86
    }
    Array Index(array=w86) -> (out0[0]=w94, out1[1]=w95, out2[2]=w96, out3[3]=w97, out4[4]=w98, out5[5]=w99, out6[6]=w100)
    $"Temperature, ºC" <- w94
    Wait(time to wait=500)
    $"Intensity, W/m2" <- w95
    $"Panel tilt angle, º" <- w96
    $"Angle of rotation, º" <- w97
    $"I, A" <- w98
    $"R,Ohm" <- w99
    $"U, V" <- w100
    call "Close Tag (Single).gvi"(tag=w91, error in=w93) -> (error out=w101)
    call "Close Configuration.gvi"(configuration=w80, error in=w101) -> (error out=w102)
    $"error out_2" <- w102
    stop if FALSE
  }
  call "Create All Message Queues.gvi"() -> (message queue=w103, error out=w104)
  while {
    event {
      on "Save in memory" Value changed {
        call "Enqueue Message (Single).gvi"(message queue in=w103, message="", Buttons WebVI="Measurements/Save in Memory Buffer")
      }
      on "Slot number/Read/" Value changed {
        call "Enqueue Message (Single).gvi"(message queue in=w103, message="", Buttons WebVI="Measurements/Read from Memory Buffer")
      }
      on "Clear Memory" Value changed {
        call "Enqueue Message (Single).gvi"(message queue in=w103, message="", Buttons WebVI="Memory Buffer/Clear")
      }
      on "Clear All Memory" Value changed {
        call "Enqueue Message (Single).gvi"(message queue in=w103, message="", Buttons WebVI="Memory Buffer/Clear all")
      }
      on "Slot number Tab 1" Value changed {
        w105 = "Calculations/Read Slot Memory"  # Buttons WebVI/Measurments
        call "Enqueue Message (Single).gvi"(message queue in=w103, message="", Buttons WebVI=w105)
      }
      on "Calculate Tab 1" Value changed {
        w106 = "Calculation/Tab 1"  # Buttons WebVI/Measurments
        call "Enqueue Message (Single).gvi"(message queue in=w103, message="", Buttons WebVI=w106)
      }
      on "Clear/ Tab 1" Value changed {
        w107 = "Clear/Tab 1"  # Buttons WebVI/Measurments
        call "Enqueue Message (Single).gvi"(message queue in=w103, message="", Buttons WebVI=w107)
      }
      on "Calc/Slot number2.1" Value changed; "Calc/Slot number2.2" Value changed; "Calc/Slot number2.3" Value changed; "Calc/Slot number2.4" Value changed; "Show / Hide Graph 1" Value changed; "Show / Hide Graph 2" Value changed; "Show / Hide Graph 3" Value changed; "Show / Hide Graph 4" Value changed {
        w108 = "Calculation/Tab 2"  # Buttons WebVI/Measurments
        call "Enqueue Message (Single).gvi"(message queue in=w103, message="", Buttons WebVI=w108)
      }
      on "Add to table Tab 4" Value changed {
        call "Enqueue Message (Single).gvi"(message queue in=w103, message="", Buttons WebVI="Create Table/Tab 3")
      }
      on "Clear Table Tab 4" Value changed {
        call "Enqueue Message (Single).gvi"(message queue in=w103, message="", Buttons WebVI="Clear Table/Tab 3")
      }
      on "Delete Last Tab 4" Value changed {
        call "Enqueue Message (Single).gvi"(message queue in=w103, message="", Buttons WebVI="Delete Last Table/Tab 3")
      }
      on "Show Graph Tab 4" Value changed {
        call "Enqueue Message (Single).gvi"(message queue in=w103, message="", Buttons WebVI="Show Chart")
      }
      on "Clear Graph Tab 4" Value changed {
        call "Enqueue Message (Single).gvi"(message queue in=w103, message="", Buttons WebVI="Clear Chart")
      }
      on "Parameter X" Value changed; "Parameter Y" Value changed {
        call "Enqueue Message (Single).gvi"(message queue in=w103, message="", Buttons WebVI="Header Tab 3")
      }
    }
    stop if FALSE
  }
  while {
    call "Dequeue Message.gvi"(message queue in=w103, error in=w104) -> (message queue out=w109, message=w110, Buttons WebVI=w111)
    case (w111) {
      frame "Initialize ", Default {
        call "Memory buffer.gvi"(Initialize/Max Number of slots memory=10, Command to buffer="Initialize") -> (Slot name indicator=w112)
        $"Memory Slot" <- w112
        w113 = "Initialize"  # Command Chart
        call "Custom Chart.gvi"(Command Graph=w113, X=0, Y=0) -> (Table out=w114, Chart=w115)
        $"Table Tab 4" <- w114
        Property Node(instance in=reference to "Slot number Tab 1", "Value"=10)
        $"Graph Tab 4" <- w115
        Property Node(instance in=reference to "Table/Measurment", "Value"=f64[][] [])
        Property Node(instance in=reference to "Slot name", "Value"="")
        Property Node(instance in=reference to "Graph Tab 1", "Value"=T1[] [])
        w116 = ["U, V", "I, A", "R, Ohm", "Angle, º", "J, W / m²", "T, ºC", "P,W", "ɳ,%"]
        $"Headers/Measurment" <- w116
        $"Headers/Calculation" <- w116
        Property Node(instance in=reference to "Table Measurments", "Value"=f64[][] [])
        call "Enqueue Message (Single).gvi"(message queue in=w109, message="Initialize", Buttons WebVI="Update Display")
      }
      frame "Measurements/Save in Memory Buffer" {
        call "Memory buffer.gvi"(Number of slot=$"Slot Number", Command to buffer="Read") -> (Read/Slot=w117)
        Property Node(instance in=w117, "Slot name"=$"Slot Name", "Measurements"=$"Input Data") -> (instance out=w118)
        w119 = "Write"  # Command
        call "Memory buffer.gvi"(Buffer Data=w118, Number of slot=$"Slot Number", Command to buffer=w119) -> (Slot name indicator=w120, Read/Slot=w121)
        $"Memory Slot" <- w120
        Property Node(instance in=w121) -> ("Measurements"=w122)
        $"Table/Measurment" <- w122
        call "Enqueue Message (Single).gvi"(message queue in=w109, message="Data recording", Buttons WebVI="Update Display")
      }
      frame "Measurements/Read from Memory Buffer" {
        w123 = "Read"  # Command
        call "Memory buffer.gvi"(Number of slot=$"Slot number/Read/", Command to buffer=w123) -> (Slot name indicator=w124, Read/Slot=w125)
        $"Memory Slot" <- w124
        Property Node(instance in=w125) -> ("Slot name"=w126, "Measurements"=w127)
        $"Read Slot Name" <- w126
        $"Table/Measurment" <- w127
        call "Enqueue Message (Single).gvi"(message queue in=w109, message="Reading From Memory Buffer", Buttons WebVI="Update Display")
      }
      frame "Memory Buffer/Clear" {
        w128 = "Clear"  # Command
        call "Memory buffer.gvi"(Number of slot=$"Slot number/Read/", Command to buffer=w128) -> (Slot name indicator=w129, Read/Slot=w130)
        $"Memory Slot" <- w129
        Property Node(instance in=w130) -> ("Slot name"=w131, "Measurements"=w132)
        $"Read Slot Name" <- w131
        $"Table/Measurment" <- w132
        call "Enqueue Message (Single).gvi"(message queue in=w109, message="Deleting memory", Buttons WebVI="Update Display")
      }
      frame "Memory Buffer/Clear all" {
        w133 = "Clear all"  # Command
        call "Memory buffer.gvi"(Number of slot=$"Slot number/Read/", Command to buffer=w133) -> (Slot name indicator=w134, Read/Slot=w135)
        $"Memory Slot" <- w134
        Property Node(instance in=w135) -> ("Slot name"=w136, "Measurements"=w137)
        $"Read Slot Name" <- w136
        $"Table/Measurment" <- w137
        call "Enqueue Message (Single).gvi"(message queue in=w109, message="Deleting all memory", Buttons WebVI="Update Display")
      }
      frame "Load Selection" {
        call "Enqueue Message (Single).gvi"(message queue in=w109, message="Load selection", Buttons WebVI="Update Display")
      }
      frame "Set Load" { }
      frame "Calculations/Read Slot Memory" {
        w138 = "Read"  # Command
        call "Memory buffer.gvi"(Number of slot=$"Slot number Tab 1", Command to buffer=w138) -> (Read/Slot=w139)
        Property Node(instance in=w139) -> ("Slot name"=w140, "Measurements"=w141)
        $"Slot name" <- w140
        $"Table Measurments" <- w141
        call "Enqueue Message (Single).gvi"(message queue in=w109, message="Buffer memory-Tab1", Buttons WebVI="Update Display")
      }
      frame "Calculation/Tab 1" {
        w142 = "Read"  # Command
        call "Memory buffer.gvi"(Number of slot=$"Slot number Tab 1", Command to buffer=w142) -> (Read/Slot=w143)
        Property Node(instance in=w143) -> ("Measurements"=w144)
        Array Index(array=w144) -> (out0[_, 0]=w145, out1[_, 1]=w146, out2[_, 4]=w147)
        Build Index And Bundle Cluster Array(w145, w146) -> (out=w148)
        Multiply(w145, w146) -> w149
        Build Index And Bundle Cluster Array(w145, w149) -> (out=w150)
        Build Cluster Array(w148, w150) -> (out=w151)
        $"Graph Tab 1" <- w151
        w152 = "Write"  # Command
        w153 = "Read"  # Command
        call "Memory buffer.gvi"(Number of slot=$"Slot number Tab 1", Command to buffer=w153) -> (Read/Slot=w154)
        w155 = 0.025  # Square Solar Panel
        Multiply(w147, w155) -> w156
        Divide(x=w149, y=w156) -> w157
        Multiply(w157, 100) -> w158
        Build Array(w149, w158) -> w159
        Transpose 2D Array(2D array=w159) -> (transposed array=w160)
        Property Node(instance in=w154, "Calculations "=w160) -> (instance out=w161)
        call "Memory buffer.gvi"(Buffer Data=w161, Number of slot=$"Slot number Tab 1", Command to buffer=w152) -> (Read/Slot=w162)
        call "Memory buffer.gvi"(Buffer Data=w162, Number of slot=$"Slot number Tab 1", Command to buffer="Read") -> (Read/Slot=w163)
        Property Node(instance in=w163) -> ("Measurements"=w164, "Calculations "=w165)
        Insert Into Array(inArray=w164, index1=6, new=w165) -> w166
        $"Table Measurments" <- w166
        call "Enqueue Message (Single).gvi"(message queue in=w109, message="Calculate Tab 1", Buttons WebVI="Update Display")
      }
      frame "Clear/Tab 1" {
        Property Node(instance in=reference to "Graph Tab 1", "Value"=T1[] [])
        Property Node(instance in=reference to "Table Measurments", "Value"=f64[][] [])
        call "Enqueue Message (Single).gvi"(message queue in=w109, message="Clear Graph Tab 1", Buttons WebVI="Update Display")
      }
      frame "Calculation/Tab 2" {
        Build Array($"Calc/Slot number2.1", $"Calc/Slot number2.2", $"Calc/Slot number2.3", $"Calc/Slot number2.4") -> w167
        Build Array($"Show / Hide Graph 1", $"Show / Hide Graph 2", $"Show / Hide Graph 3", $"Show / Hide Graph 4") -> w168
        for {
          w169 = each element of w168
          w170 = each element of w167
          case (w169) {
            frame False, Default {
              w177 = cluster{"Element 1": f64[], "Element 2": f64[]} {all zero or empty}
              w174 = default
              w175 = T1[] []
              w176 = w177
            }
            frame True {
              w178 = "Read"  # Command
              call "Memory buffer.gvi"(Number of slot=w170, Command to buffer=w178) -> (Read/Slot=w179)
              Property Node(instance in=w179) -> (instance out=w180)
              Property Node(instance in=w180) -> ("Measurements"=w181, "Calculations "=w182, "Slot name"=w174)
              Array Index(array=w181) -> (out0[_, 0]=w183, out1[_, 1]=w184, out2[_, 2]=w185)
              Build Index And Bundle Cluster Array(w183, w184) -> (out=w186)
              Array Index(array=w182) -> (out0[_, 0]=w187, out1[_, 1]=w188)
              Build Index And Bundle Cluster Array(w183, w187) -> (out=w189)
              Build Cluster Array(w186, w189) -> (out=w175)
              Build Cluster(w185, w188) -> w176
            }
          }
          append w174 to w171
          concatenate w175 onto w172
          append w176 to w173
        }
        $"Graph 1 Tab 3" <- w172
        Array Index(array=w171) -> (out0[_]=w190, out1[_]=w191, out2[_]=w192, out3[_]=w193)
        $"Slot name2.1" <- w190
        $"Slot name2.2" <- w191
        $"Slot name2.3" <- w192
        $"Slot name2.4" <- w193
        $"Graph 2 Tab 3" <- w173
        call "Enqueue Message (Single).gvi"(message queue in=w109, message="Calculation Tab 2", Buttons WebVI="Update Display")
      }
      frame "Header Tab 3" {
        Property Node(instance in=reference to "Parameter X") -> ("Items"=w194, "Value"=w195)
        Array Index(array=w194) -> (out0[w195]=w196)
        Property Node(instance in=reference to "Parameter Y") -> ("Items"=w197, "Value"=w198)
        Array Index(array=w197) -> (out0[w198]=w199)
        Build Array(w196, w199) -> w200
        $"Header XY" <- w200
      }
      frame "Create Table/Tab 3" {
        w201 = "Write/Read "  # Command Chart
        call "Custom Chart.gvi"(Command Graph=w201, X=$X, Y=$Y) -> (Table out=w202)
        $"Table Tab 4" <- w202
        call "Enqueue Message (Single).gvi"(message queue in=w109, message="Crate Table Tab 3", Buttons WebVI="Update Display")
      }
      frame "Clear Table/Tab 3" {
        w203 = "Clear Table"  # Command Chart
        call "Custom Chart.gvi"(Command Graph=w203, X=$X, Y=$Y) -> (Table out=w204)
        $"Table Tab 4_2" <- w204
      }
      frame "Delete Last Table/Tab 3" {
        w205 = "Delete last"  # Command Chart
        call "Custom Chart.gvi"(Command Graph=w205, X=$X, Y=$Y) -> (Table out=w206)
        $"Table Tab 4" <- w206
      }
      frame "Show Chart" {
        call "Custom Chart.gvi"(Command Graph="Graph", X=$X, Y=$Y) -> (Chart=w207)
        $"Graph Tab 4" <- w207
      }
      frame "Clear Chart" {
        w208 = "Clear Chart"  # Command Chart
        call "Custom Chart.gvi"(Command Graph=w208, X=$X, Y=$Y) -> (Chart=w209)
        $"Graph Tab 4" <- w209
      }
      frame "Update Display" {
        $"Update Display" <- w110
      }
    }
    stop if FALSE
  }
