vi "Dequeue Message SLC.gvi"   [LabVIEW NXG 5.0.0]
# This VI pulls messages off the Message Queue.
inputs:
  "queue in": Queue<"Message Cluster SLC.gtype">
  "error in": error
outputs:
  "queue out": Queue<"Message Cluster SLC.gtype">
  "Message": string
  "Message Data": variant
  "Buttons SLC": "Buttons SLC.gtype"
types:
  "Buttons SLC.gtype" = enum{"Initialize", "Connecting Solar Panel", "Cooling Conditions", "Heating Conditions", "Dimming conditions", "Tilt angle", "Power setting", "Load ", "Set Load", "Set", "Get Load", "Get"}
  "Message Cluster SLC.gtype" = cluster{"Message": string, "Message Data": variant, "Buttons SLC": "Buttons SLC.gtype"}
diagram:
  Dequeue Element(queue=$"queue in") -> (element=w1, error out=w2, queue out=w3)
  $"queue out" <- w3
  Property Node(instance in=w1) -> ("Message"=w4, "Message Data"=w5, "Buttons SLC"=w6)
  $Message <- w4
  $"Message Data" <- w5
  $"Buttons SLC" <- w6
  Merge Errors($"error in", w2)
