vi "Enqueue Message SLC.gvi"   [LabVIEW NXG 5.0.0]
inputs:
  "error in": error
  "Buttons SLC": "Buttons SLC.gtype" = "Initialize"
  "message": string
  "message data": variant
  "message queue in": Queue<"Message Cluster SLC.gtype">
  "priority message": bool
outputs:
  "message queue out": Queue<"Message Cluster SLC.gtype">
  "error out": error
types:
  "Buttons SLC.gtype" = enum{"Initialize", "Connecting Solar Panel", "Cooling Conditions", "Heating Conditions", "Dimming conditions", "Tilt angle", "Power setting", "Load ", "Set Load", "Set", "Get Load", "Get"}
  "Message Cluster SLC.gtype" = cluster{"Message": string, "Message Data": variant, "Buttons SLC": "Buttons SLC.gtype"}
diagram:
  $"message queue out" <- $"message queue in"
  Property Node(instance in="Message Cluster SLC.gtype" {all zero or empty}, "Message"=$message, "Message Data"=$"message data", "Buttons SLC"=$"Buttons SLC") -> (instance out=w1)
  case ($"priority message") {
    frame False, Default {
      Enqueue Element(element=w1, error in=$"error in", queue=$"message queue in") -> (error out=w2)
    }
    frame True {
      Enqueue Element(element=w1, error in=$"error in", queue=$"message queue in") -> (error out=w2)
    }
  }
  $"error out" <- w2
