vi "Create All Message Queues.gvi"   [LabVIEW NXG 5.0.0]
# This VI creates and initializes all the message queues for your application. If your application requires more than one message queue, right-click the "Message Queues" constant above and select Open Type Def.  Add the new Message Queue(s) to the type definition, then initialize them in this VI.
inputs:
  "error in": error
outputs:
  "message queue": Queue<"Message Cluster.gtype">
  "error out": error
types:
  "Buttons WebVI.gtype" = enum{"Initialize ", "Measurements/Save in Memory Buffer", "Measurements/Read from Memory Buffer", "Memory Buffer/Clear", "Memory Buffer/Clear all", "Load Selection", "Set Load", "Calculations/Read Slot Memory", "Calculation/Tab 2", "Calculation/Tab 1", "Clear/Tab 1", "Update Display", "Create Table/Tab 3", "Show Chart", "Clear Table/Tab 3", "Delete Last Table/Tab 3", "Clear Chart", "Header Tab 3"}
  "Message Cluster.gtype" = cluster{"Message": string, "Message Data": variant, "Buttons WebVI": "Buttons WebVI.gtype"}
uses:
  WebApp::Support::Message Queue WEB::Obtain Message.gvi
  WebApp::Support::Message Queue WEB::Enqueue Message (Single).gvi
diagram:
  case ($"error in") {
    frame No Error {
      call "Obtain Message.gvi"(error in=$"error in") -> (message queue=w2, error out=w3)
      call "Enqueue Message (Single).gvi"(message queue in=w2, message="Initialize", Buttons WebVI="Initialize ", error in=w3) -> (error out=w1)
    }
    frame Error {
      w1 = $"error in"
      w2 = default
    }
  }
  $"message queue" <- w2
  $"error out" <- w1
