vi "Enqueue Message (Single).gvi"   [LabVIEW NXG 5.0.0]
# For a regular message, enqueue the message. For a priority message, enqueue it at the front of the queue.
inputs:
  "message queue in": Queue<"Message Cluster.gtype">, required
  "Buttons WebVI": "Buttons WebVI.gtype" = "Initialize "
  "message": string, required
  "message data": variant
  "error in": error
  "priority message": bool
outputs:
  "message queue out": Queue<"Message Cluster.gtype">
  "error out": error
types:
  "Buttons WebVI.gtype" = enum{"Initialize ", "Measurements/Save in Memory Buffer", "Measurements/Read from Memory Buffer", "Memory Buffer/Clear", "Memory Buffer/Clear all", "Load Selection", "Set Load", "Calculations/Read Slot Memory", "Calculation/Tab 2", "Calculation/Tab 1", "Clear/Tab 1", "Update Display", "Create Table/Tab 3", "Show Chart", "Clear Table/Tab 3", "Delete Last Table/Tab 3", "Clear Chart", "Header Tab 3"}
  "Message Cluster.gtype" = cluster{"Message": string, "Message Data": variant, "Buttons WebVI": "Buttons WebVI.gtype"}
diagram:
  $"message queue out" <- $"message queue in"
  Property Node(instance in="Message Cluster.gtype" {all zero or empty}, "Message"=$message, "Message Data"=$"message data", "Buttons WebVI"=$"Buttons WebVI") -> (instance out=w1)
  # For a regular message, enqueue the message.  For a priority message, enqueue it at the front of the queue.
  case ($"priority message") {
    frame False, Default {
      Enqueue Element(element=w1, error in=$"error in", queue=$"message queue in") -> (error out=w2)
    }
    frame True {
      Enqueue Element At Opposite End(element=w1, error in=$"error in", queue=$"message queue in") -> (error out=w2)
    }
  }
  $"error out" <- w2
