vi "Load selection.gvi"   [LabVIEW NXG 4.0.0]
inputs:
  "List box": "Listbox reference"[]
  "Value": i32[] = [1000, 2000, 3000]
outputs:
  "Sum": i32
diagram:
  Property Node(instance in=$"List box") -> ("Value"=w1)
  for {
    w2 = each element of w1
    Array Index(array=$Value) -> (out0[w2]=w4)
    append w4 to w3
  }
  Add Array Elements(numeric array=w3) -> (sum=w5)
  $Sum <- w5
