vi "Main.Lab.gviweb"   [LabVIEW NXG 5.0.0]
panel controls:
  "Connecting Solar Panels": i32 = -1
  "Solar panel tilt angle, º": i32
  "Power setting for the light source, W": i32
  "Cooling conditions": i32 = -1
  "Clear/ Tab 1": bool
  "Isc": f64
  "Uoc": f64
  "Clear Graph Tab 4": bool
  "Save in memory": bool
  "Slot Name": string
  "Slot Number": i32 = "Slot 1"(0)
  "Imp": f64
  "Ump": f64
  "FF/Calculation": bool
  "Add to table Tab 4": bool
  "Calculate Tab 1": bool
  "T1": f64
  "T2": f64
  "Uoc/Calculation_3": f64
  "Uoc2": f64
  "Kt/Calculation": bool
  "Dimming conditions": i32 = -1
  "Heating conditions": i32 = -1
  "1х, Ohm": i32[]
  "10х": i32[]
  "100х": i32[]
  "Set Load": bool
  "Calculate average": bool
  "Parameter Y": i32 = -1
  "Parameter X": i32 = -1
  "Calculation": i32
  "1000х": i32[]
  "History Graph V/Measurment": i16 = 400
  "History Graph I/Measurment": i16 = 400
  "History Graph T/Measurment": i16 = 400
  "Clear All Memory": bool
  "Clear Table Tab 4": bool
  "Slot number/Read/": i32 = "1"(0)
  "Manual/Automatic": enum{"Manual", "Automatic"} = "Manual"
  "Show Graph Tab 4": bool
  "Clear Memory": bool
  "Slot number Tab 1": i32 = "1"(0)
  "Calc/Slot number2.1": i32 = "1"(0)
  "Show / Hide Graph 1": bool
  "Delete Last Tab 4": bool
  "Change History J/Measurment": i32
  "History Graph R/Measurment": i16 = 400
  "History Graph J/Measurment": i16 = 400
  "Show / Hide Graph 2": bool
  "Calc/Slot number2.2": i32 = "1"(0)
  "Calc/Slot number2.3": i32 = "1"(0)
  "Calc/Slot number2.4": i32 = "1"(0)
  "Show / Hide Graph 3": bool
  "Show / Hide Graph 4": bool
  "Input Data": f64[][] = [[1.814, 0.0233, 27.1, 0, 500, 70], [1.802, 0.069, 26.11, 0, 500, 75], [1.794, 0.109, 16.45, 0, 500, 73], [1.792, 0.151, 11.86, 0, 500, 72], [1.78, 0.192, 9.27, 0, 500, 73], [1.773, 0.231, 7.5, 0, 500, 0], [1.765, 0.273, 6.46, 0, 500, 0], [1.762, 0.315, 5.59, 0, 500, 0], [1.754, 0.358, 4.89, 0, 500, 0], [1.734, 0.399, 4.34, 0, 500, 0], [1.725, 0.439, 3.78, 0, 500, 0], [1.721, 0.48, 3.54, 0, 500, 0], [1.711, 0.521, 3.15, 0, 500, 0], [1.688, 0.561, 3.01, 0, 500, 0], [1.667, 0.602, 2.7, 0, 500, 0], [1.657, 0.636, 2.59, 0, 500, 0], [1.648, 0.678, 2.32, 0, 500, 0], [1.613, 0.718, 2.1, 0, 500, 0], [1.244, 0.761, 1.64, 0, 500, 0], [0.461, 0.793, 0.58, 0, 500, 0], [0.016, 0.798, 0.02, 0, 500, 0]]
  "X": f64
  "Y": f64
  "error in_2": error
  "error in_6": error
  "Array Constant_2": string[] = ["single", "parallel 2", "parallel 2 with diodes ", "series  2", "series 2 with diodes "]
  "Set": bool
  "error in_7": error
  "Connecting Solar Panels _2": i32 = -1
  "Set_2": bool
  "Set Load_2": bool
panel indicators:
  "Start/Stop lab": bool
  "Refresh": bool
  "Lab Manual": bool
  "Graph Voltage": f64[]
  "Clear Graph V/Measurment": bool
  "Change history V/Measurment": bool
  "Isc/Calculation": bool
  "Uoc/Calculation": bool
  "Graph Tab 4": cluster{"Element 1": f64[], "Element 2": f64[]}
  "Print Page": bool
  "Slot name": string
  "Imp/Calculation": bool
  "Ump/Calculation": bool
  "FF": f64
  "Graph 1 Tab 3": T1[]
  "Graph 2 Tab 3": cluster{"Element 1": f64[], "Element 2": f64[]}[]
  "T1/Calclation": bool
  "T2/Calculation": bool
  "Uoc1/Calculation": bool
  "Uoc2/Calculation": bool
  "Kt": f64
  "Total Load, Ohm": i32
  "URL Image_2": string
  "URL Image_3": string
  "Graph Current": f64[]
  "Clear Graph I/Measurment": bool
  "Graph Temperature": f64[]
  "Clear Graph T/Measurment": bool
  "Change History I/Measurment": bool
  "Change History T/Measurment": bool
  "URL Image_4": string
  "Memory Slot": string[]
  "Read Slot Name": string
  "URL Image_5": string
  "LED": bool
  "button_38": bool
  "Table/Measurment": f64[][]
  "URL Image_6": string
  "URL Image_7": string
  "Graph Tab 1": T1[]
  "Web Camera": string
  "Temperature, ºC": f64
  "Delete Last": bool
  "Slot name2.1": string
  "Slot name2.2": string
  "Slot name2.3": string
  "Update Display": string
  "Graph Load": f64[]
  "Clear Graph R/Measurment": bool
  "Change History R/Measurment": bool
  "Graph_10": f64[]
  "Clear Graph J/Measurment": bool
  "Change History J/Measurment_2": bool
  "Table Measurments": f64[][]
  "Headers/Calculation": string[]
  "Slot name2.4": string
  "Headers/Measurment": string[]
  "Intensity, W/m2": f64
  "Panel tilt angle, º": f64
  "Angle of rotation, º": f64
  "Table/Avarage": f64[][]
  "Table Tab 4": f64[][]
  "Header XY": string[]
  "Table Tab 4_2": f64[][]
  "error out_2": error
  "error out_3": error
  "Connecting Solar Panel": string
  "Cooling": string
  "Heating": string
  "Dimming": string
  "Angle": i32
  "Power": i32
  "Load": string
  "appended array": string[]
  "Value_5": string[]
  "error out_5": error
  "appended array_2": string[]
  "logical AND": bool
  "logical AND_2": bool
  "element": string
  "I, A": f64
  "R,Ohm": f64
  "U, V": f64
  "Connecting Solar Panel_2": string
  "Connecting Solar Panel_3": string
types:
  T1 = cluster{"Element 1": cluster{"Element 1": f64, "Element 2": f64}[]}
uses:
  NI::Skyline::Configuration::Open Configuration.gvi
  NI::Skyline::MessageHTTP::Open.gvi
  NI::Skyline::MessageHTTP::Publish.gvi
  NI::Skyline::MessageHTTP::Flush.gvi
  NI::Skyline::Configuration::Close Configuration.gvi
  NI::Skyline::MessageHTTP::Subscribe.gvi
  NI::Skyline::MessageHTTP::Read.gvi
  NI::Skyline::MessageHTTP::Unsubscribe.gvi
  WebApp::Support::Message Queue SLC::Obtain Message SLC.gvi
  WebApp::Support::Message Queue SLC::Enqueue Message SLC.gvi
  WebApp::Support::Message Queue SLC::Dequeue Message SLC.gvi
  WebApp::Load Selection::Load selection.gvi
  NI::Skyline::Configuration::Open Configuration API Key.gvi
  NI::Skyline::TagHTTP::Open Tag.gvi
  NI::Skyline::TagHTTP::Write Tag (String).gvi
  NI::Skyline::TagHTTP::Close Tag (Single).gvi
  NI::Skyline::TagHTTP::Query Tags.gvi
  NI::Skyline::TagHTTP::Read Tag (DBL).gvi
  WebApp::Support::Message Queue WEB::Create All Message Queues.gvi
  WebApp::Support::Message Queue WEB::Enqueue Message (Single).gvi
  WebApp::Support::Message Queue WEB::Dequeue Message.gvi
  WebApp::Memory Buffer::Memory buffer.gvi
  WebApp::Custom Chart::Custom Chart.gvi
diagram:
  while {
    disable {
      frame Enabled { }
      frame Disabled {
        Property Node() -> (instance in=w1, "Value"=w2)
        Is Equal(x=w2, y=0) -> w3
        Property Node() -> (instance in=w4, "Value"=w5)
        Is Equal(x=w5, y=0) -> w6
        Logical And(w3, w6) -> w7
        case (w7) {
          frame False, Default {
            Property Node("ValueSignaling"="0")
          }
          frame True {
            Property Node("ValueSignaling"="parallel 2")
          }
        }
        Property Node() -> (instance in=w8, "Value"=w9)
        Is Equal(x=w9, y=1) -> w10
        Property Node() -> (instance in=w11, "Value"=w12)
        Is Equal(x=w12, y=0) -> w13
        Logical And(w10, w13) -> w14
        case (w14) {
          frame False, Default { }
          frame True {
            Property Node("ValueSignaling"="series  2")
          }
        }
        $"logical AND" <- w7
        Property Node() -> (instance in=w15, "Value"=w16)
        Is Equal(x=w16, y=0) -> w17
        Property Node() -> (instance in=w18, "Value"=w19)
        Is Equal(x=w19, y=1) -> w20
        Logical And(w17, w20) -> w21
        $"logical AND_2" <- w21
        case (w21) {
          frame False, Default { }
          frame True {
            Property Node("ValueSignaling"="parallel 2 with diodes ") -> (instance in=w22)
          }
        }
      }
    }
    Array Index(array=string[] []) -> (out0[$"Connecting Solar Panels _2"]=w23)
    $element <- w23
    stop if FALSE
  }
  disable {
    frame Enabled { }
    frame Disabled {
      sequence {
        frame 0 {
          call "Open Configuration.gvi"(server url="http://localhost:80/", username="admin", password="password") -> (configuration=w24, error out=w25)
          call "Open.gvi"(error in=w25, configuration=w24) -> (message session=w26, error out=w27)
        }
        frame 1 {
          s1 = w26  # shift register
          s2 = w27  # shift register
          while {
            call "Publish.gvi"(message session in=s1, topic="TopicName", message="New Message\n..................\n..................", error in=s2) -> (message session out=w28, error out=w29)
            next s1 = w28
            next s2 = w29
            stop if FALSE
          }
        }
        frame 2 {
          call "Flush.gvi"(message session in=s1, error in=s2) -> (error out=w30)
          call "Close Configuration.gvi"(configuration=w24, error in=w30)
        }
      }
      sequence {
        frame 0 {
          call "Open Configuration.gvi"(server url="http://localhost:80/", username="admin", password="password") -> (configuration=w31, error out=w32)
          call "Open.gvi"(error in=w32, configuration=w31) -> (message session=w33, error out=w34)
        }
        frame 1 {
          call "Subscribe.gvi"(message session in=w33, topic="TopicName", error in=w34) -> (message session out=w35, error out=w36)
        }
        frame 2 {
          s3 = w35  # shift register
          s4 = w36  # shift register
          while {
            call "Read.gvi"(message session in=s3, error in=s4) -> (message session out=w37, topic=w38, message=w39, error out=w40)
            sequence (after w38) (after w39) {
              frame 0 { }
            }
            next s3 = w37
            next s4 = w40
            stop if FALSE
          }
        }
        frame 3 {
          call "Unsubscribe.gvi"(message session in=s3, topic="TopicName", error in=s4) -> (message session out=w41, error out=w42)
        }
        frame 4 {
          call "Flush.gvi"(message session in=w41, error in=w42) -> (error out=w43)
          call "Close Configuration.gvi"(configuration=w31, error in=w43)
        }
      }
    }
  }
  call "Obtain Message SLC.gvi"() -> (queue out=w44, error out=w45)
  call "Enqueue Message SLC.gvi"(message queue in=w44, Buttons SLC="Initialize", error in=w45) -> (message queue out=w46, error out=w47)
  while {
    event {
      on "Connecting Solar Panels" Value changed {
        call "Enqueue Message SLC.gvi"(message queue in=w46, message="", Buttons SLC="Connecting Solar Panel")
      }
      on "Cooling conditions" Value changed {
        call "Enqueue Message SLC.gvi"(message queue in=w46, message="", Buttons SLC="Cooling Conditions")
      }
      on "Heating conditions" Value changed {
        call "Enqueue Message SLC.gvi"(message queue in=w46, message="", Buttons SLC="Heating Conditions")
      }
      on "Dimming conditions" Value changed {
        call "Enqueue Message SLC.gvi"(message queue in=w46, message="", Buttons SLC="Dimming conditions")
      }
      on "Solar panel tilt angle, º" Value changed {
        call "Enqueue Message SLC.gvi"(message queue in=w46, message="", Buttons SLC="Tilt angle")
      }
      on "Power setting for the light source, W" Value changed {
        call "Enqueue Message SLC.gvi"(message queue in=w46, message="", Buttons SLC="Power setting")
      }
      on "1000х" Value changed; "100х" Value changed; "10х" Value changed; "1х, Ohm" Value changed {
        call "Enqueue Message SLC.gvi"(message queue in=w46, message="", Buttons SLC="Load ")
      }
      on "Set Load" Value changed {
        call "Enqueue Message SLC.gvi"(message queue in=w46, message="", Buttons SLC="Set Load")
      }
      on "Set" Value changed {
        call "Enqueue Message SLC.gvi"(message queue in=w46, message="", Buttons SLC="Set")
      }
    }
    stop if FALSE
  }
  while {
    call "Dequeue Message SLC.gvi"(message queue in=w46, error in=w47) -> (message queue out=w48, Message=w49, Buttons SLC=w50)
    case (w50) {
      frame "Initialize", Default { }
      frame "Connecting Solar Panel" {
        Property Node(instance in=reference to "Connecting Solar Panels", "Items"=string[] []) -> ("Items"=w51, "Value"=w52)
        Array Index(array=w51) -> (out0[w52]=w53)
        $"Connecting Solar Panel" <- w53
      }
      frame "Cooling Conditions" {
        Property Node(instance in=reference to "Cooling conditions") -> ("Items"=w54, "Value"=w55)
        Array Index(array=w54) -> (out0[w55]=w56)
        $Cooling <- w56
      }
      frame "Heating Conditions" {
        Property Node(instance in=reference to "Heating conditions") -> ("Items"=w57, "Value"=w58)
        Array Index(array=w57) -> (out0[w58]=w59)
        $Heating <- w59
      }
      frame "Dimming conditions" {
        Property Node(instance in=reference to "Dimming conditions") -> ("Items"=w60, "Value"=w61)
        Array Index(array=w60) -> (out0[w61]=w62)
        $Dimming <- w62
      }
      frame "Tilt angle" {
        Property Node(instance in=reference to "Solar panel tilt angle, º") -> ("Value"=w63)
        $Angle <- w63
      }
      frame "Power setting" {
        Property Node(instance in=reference to "Power setting for the light source, W") -> ("Value"=w64)
        $Power <- w64
      }
      frame "Load " {
        case ($"Manual/Automatic") {
          frame "Manual", Default {
            Property Node(instance in=reference to "1000х", "Disabled"=FALSE)
            call "Load selection.gvi"(List box=reference to "1000х", Value=[1000, 2000, 3000]) -> (Sum=w65, Load=w66)
            $Load <- w66
            Property Node(instance in=reference to "100х", "Disabled"=FALSE)
            call "Load selection.gvi"(List box=reference to "100х", Value=[100, 200, 400, 500]) -> (Sum=w67, Load=w68)
            Property Node(instance in=reference to "10х", "Disabled"=FALSE) -> (instance out=w69)
            call "Load selection.gvi"(List box=w69, Value=[10, 20, 40, 50]) -> (Sum=w70, Load=w71)
            call "Load selection.gvi"(List box=reference to "1х, Ohm", Value=[1, 2, 4, 5]) -> (Sum=w72, Load=w73)
            Add(w65, w67, w70, w72) -> w74
            $"Total Load, Ohm" <- w74
            Build Array(w66, w68, w71, w73) -> w75
            $"appended array" <- w75
            Property Node(instance in=reference to "Set Load", "Disabled"=FALSE)
            Property Node(instance in=reference to "1х, Ohm", "Disabled"=FALSE)
            Property Node(instance in=reference to "Total Load, Ohm", "Disabled"=FALSE)
          }
          frame "Automatic" {
            Property Node(instance in=reference to "1000х", "Disabled"=TRUE)
            Property Node(instance in=reference to "100х", "Disabled"=TRUE)
            Property Node(instance in=reference to "10х", "Disabled"=TRUE)
            Property Node(instance in=reference to "Set Load", "Disabled"=TRUE)
            Property Node(instance in=reference to "1х, Ohm", "Disabled"=TRUE)
            Property Node(instance in=reference to "Total Load, Ohm", "Disabled"=TRUE)
          }
        }
      }
      frame "Set Load" {
        call "Open Configuration API Key.gvi"(server url="https://api.systemlinkcloud.com/", api key="zYUbuW0YNkg1G__lXfJiGVBNWME-HlVd2a5NUHp-IP", error in=$"error in_6") -> (configuration=w76)
        Property Node(instance in=reference to "appended array") -> ("Value"=w77)
        for {
          w78 = each element of ["MV-R4", "MV-R3", "MV-R2", "MV-R1"]
          w79 = each element of w77
          Wait(time to wait=200)
          call "Open Tag.gvi"(path=w78, data type="String", configuration=w76) -> (tag=w80)
          call "Write Tag (String).gvi"(tag in=w80, value=w79) -> (tag out=w81, error out=w82)
        }
        call "Close Tag (Single).gvi"(tag=w81, error in=w82) -> (error out=w83)
        call "Close Configuration.gvi"(configuration=w76, error in=w83) -> (error out=w84)
        $"error out_3" <- w84
        $Value_5 <- w77
      }
      frame "Set" {
        call "Open Configuration API Key.gvi"(server url="https://api.systemlinkcloud.com/", api key="zYUbuW0YNkg1G__lXfJiGVBNWME-HlVd2a5NUHp-IP", error in=$"error in_7") -> (configuration=w85)
        Property Node(instance in=reference to "Connecting Solar Panel") -> ("Value"=w86)
        Property Node(instance in=reference to "Cooling") -> ("Value"=w87)
        Property Node(instance in=reference to "Heating") -> ("Value"=w88)
        Property Node(instance in=reference to "Dimming") -> ("Value"=w89)
        Property Node(instance in=reference to "Angle") -> ("Value"=w90)
        Number To Decimal String(number=w90) -> (decimal integer string=w91)
        Property Node(instance in=reference to "Power") -> ("Value"=w92)
        Number To Decimal String(number=w92) -> (decimal integer string=w93)
        Build Array(w86, w87, w88, w89, w91, w93) -> w94
        for {
          w95 = each element of ["MV-CS", "MV-CC", "MV-HC", "MV-DC", "MV-A", "MV-P"]
          w96 = each element of w94
          Wait(time to wait=200)
          call "Open Tag.gvi"(path=w95, data type="String", configuration=w85) -> (tag=w97)
          call "Write Tag (String).gvi"(tag in=w97, value=w96) -> (tag out=w98, error out=w99)
        }
        call "Close Tag (Single).gvi"(tag=w98, error in=w99) -> (error out=w100)
        call "Close Configuration.gvi"(configuration=w85, error in=w100) -> (error out=w101)
        $"error out_5" <- w101
        $"appended array_2" <- w94
      }
    }
    stop if FALSE
  }
  while {
    call "Open Configuration API Key.gvi"(server url="https://api.systemlinkcloud.com/", api key="zYUbuW0YNkg1G__lXfJiGVBNWME-HlVd2a5NUHp-IP", error in=$"error in_2") -> (configuration=w102, error out=w103)
    call "Query Tags.gvi"(paths=["PV-TT", "PV-IT", "PV-AT", "PV-AR", "PV-I", "PV-R", "PV-U"], error in=w103, configuration=w102) -> (tags=w104, error out=w105)
    for {
      w106 = each element of w104
      Property Node(instance in=w106) -> ("Path"=w108, "Datatype"=w109)
      call "Open Tag.gvi"(path=w108, data type=w109, error in=w105, configuration=w102) -> (tag=w110, error out=w111)
      call "Read Tag (DBL).gvi"(tag in=w110, error in=w111) -> (tag out=w112, value=w113, error out=w114)
      append w113 to w107
    }
    Array Index(array=w107) -> (out0[0]=w115, out1[1]=w116, out2[2]=w117, out3[3]=w118, out4[4]=w119, out5[5]=w120, out6[6]=w121)
    $"Temperature, ºC" <- w115
    $"Intensity, W/m2" <- w116
    $"Panel tilt angle, º" <- w117
    $"Angle of rotation, º" <- w118
    $"I, A" <- w119
    Wait(time to wait=500)
    $"R,Ohm" <- w120
    $"U, V" <- w121
    call "Close Tag (Single).gvi"(tag=w112, error in=w114) -> (error out=w122)
    call "Close Configuration.gvi"(configuration=w102, error in=w122) -> (error out=w123)
    $"error out_2" <- w123
    stop if FALSE
  }
  call "Create All Message Queues.gvi"() -> (message queue=w124, error out=w125)
  while {
    event {
      on "Save in memory" Value changed {
        call "Enqueue Message (Single).gvi"(message queue in=w124, message="", Buttons WebVI="Measurements/Save in Memory Buffer")
      }
      on "Slot number/Read/" Value changed {
        call "Enqueue Message (Single).gvi"(message queue in=w124, message="", Buttons WebVI="Measurements/Read from Memory Buffer")
      }
      on "Clear Memory" Value changed {
        call "Enqueue Message (Single).gvi"(message queue in=w124, message="", Buttons WebVI="Memory Buffer/Clear")
      }
      on "Clear All Memory" Value changed {
        call "Enqueue Message (Single).gvi"(message queue in=w124, message="", Buttons WebVI="Memory Buffer/Clear all")
      }
      on "Slot number Tab 1" Value changed {
        w126 = "Calculations/Read Slot Memory"  # Buttons WebVI/Measurments
        call "Enqueue Message (Single).gvi"(message queue in=w124, message="", Buttons WebVI=w126)
      }
      on "Calculate Tab 1" Value changed {
        w127 = "Calculation/Tab 1"  # Buttons WebVI/Measurments
        call "Enqueue Message (Single).gvi"(message queue in=w124, message="", Buttons WebVI=w127)
      }
      on "Clear/ Tab 1" Value changed {
        w128 = "Clear/Tab 1"  # Buttons WebVI/Measurments
        call "Enqueue Message (Single).gvi"(message queue in=w124, message="", Buttons WebVI=w128)
      }
      on "Calc/Slot number2.1" Value changed; "Calc/Slot number2.2" Value changed; "Calc/Slot number2.3" Value changed; "Calc/Slot number2.4" Value changed; "Show / Hide Graph 1" Value changed; "Show / Hide Graph 2" Value changed; "Show / Hide Graph 3" Value changed; "Show / Hide Graph 4" Value changed {
        w129 = "Calculation/Tab 2"  # Buttons WebVI/Measurments
        call "Enqueue Message (Single).gvi"(message queue in=w124, message="", Buttons WebVI=w129)
      }
      on "Add to table Tab 4" Value changed {
        call "Enqueue Message (Single).gvi"(message queue in=w124, message="", Buttons WebVI="Create Table/Tab 3")
      }
      on "Clear Table Tab 4" Value changed {
        call "Enqueue Message (Single).gvi"(message queue in=w124, message="", Buttons WebVI="Clear Table/Tab 3")
      }
      on "Delete Last Tab 4" Value changed {
        call "Enqueue Message (Single).gvi"(message queue in=w124, message="", Buttons WebVI="Delete Last Table/Tab 3")
      }
      on "Show Graph Tab 4" Value changed {
        call "Enqueue Message (Single).gvi"(message queue in=w124, message="", Buttons WebVI="Show Chart")
      }
      on "Clear Graph Tab 4" Value changed {
        call "Enqueue Message (Single).gvi"(message queue in=w124, message="", Buttons WebVI="Clear Chart")
      }
      on "Parameter X" Value changed; "Parameter Y" Value changed {
        call "Enqueue Message (Single).gvi"(message queue in=w124, message="", Buttons WebVI="Header Tab 3")
      }
    }
    stop if FALSE
  }
  while {
    call "Dequeue Message.gvi"(message queue in=w124, error in=w125) -> (message queue out=w130, message=w131, Buttons WebVI=w132)
    case (w132) {
      frame "Initialize ", Default {
        call "Memory buffer.gvi"(Initialize/Max Number of slots memory=10, Command to buffer="Initialize") -> (Slot name indicator=w133)
        $"Memory Slot" <- w133
        w134 = "Initialize"  # Command Chart
        call "Custom Chart.gvi"(Command Graph=w134, X=0, Y=0) -> (Table out=w135, Chart=w136)
        $"Table Tab 4" <- w135
        Property Node(instance in=reference to "Slot number Tab 1", "Value"=10)
        $"Graph Tab 4" <- w136
        Property Node(instance in=reference to "Table/Measurment", "Value"=f64[][] [])
        Property Node(instance in=reference to "Slot name", "Value"="")
        Property Node(instance in=reference to "Graph Tab 1", "Value"=T1[] [])
        w137 = ["U, V", "I, A", "R, Ohm", "Angle, º", "J, W / m²", "T, ºC", "P,W", "ɳ,%"]
        $"Headers/Measurment" <- w137
        $"Headers/Calculation" <- w137
        Property Node(instance in=reference to "Table Measurments", "Value"=f64[][] [])
        call "Enqueue Message (Single).gvi"(message queue in=w130, message="Initialize", Buttons WebVI="Update Display")
      }
      frame "Measurements/Save in Memory Buffer" {
        call "Memory buffer.gvi"(Number of slot=$"Slot Number", Command to buffer="Read") -> (Read/Slot=w138)
        Property Node(instance in=w138, "Slot name"=$"Slot Name", "Measurements"=$"Input Data") -> (instance out=w139)
        w140 = "Write"  # Command
        call "Memory buffer.gvi"(Buffer Data=w139, Number of slot=$"Slot Number", Command to buffer=w140) -> (Slot name indicator=w141, Read/Slot=w142)
        $"Memory Slot" <- w141
        Property Node(instance in=w142) -> ("Measurements"=w143)
        $"Table/Measurment" <- w143
        call "Enqueue Message (Single).gvi"(message queue in=w130, message="Data recording", Buttons WebVI="Update Display")
      }
      frame "Measurements/Read from Memory Buffer" {
        w144 = "Read"  # Command
        call "Memory buffer.gvi"(Number of slot=$"Slot number/Read/", Command to buffer=w144) -> (Slot name indicator=w145, Read/Slot=w146)
        $"Memory Slot" <- w145
        Property Node(instance in=w146) -> ("Slot name"=w147, "Measurements"=w148)
        $"Read Slot Name" <- w147
        $"Table/Measurment" <- w148
        call "Enqueue Message (Single).gvi"(message queue in=w130, message="Reading From Memory Buffer", Buttons WebVI="Update Display")
      }
      frame "Memory Buffer/Clear" {
        w149 = "Clear"  # Command
        call "Memory buffer.gvi"(Number of slot=$"Slot number/Read/", Command to buffer=w149) -> (Slot name indicator=w150, Read/Slot=w151)
        $"Memory Slot" <- w150
        Property Node(instance in=w151) -> ("Slot name"=w152, "Measurements"=w153)
        $"Read Slot Name" <- w152
        $"Table/Measurment" <- w153
        call "Enqueue Message (Single).gvi"(message queue in=w130, message="Deleting memory", Buttons WebVI="Update Display")
      }
      frame "Memory Buffer/Clear all" {
        w154 = "Clear all"  # Command
        call "Memory buffer.gvi"(Number of slot=$"Slot number/Read/", Command to buffer=w154) -> (Slot name indicator=w155, Read/Slot=w156)
        $"Memory Slot" <- w155
        Property Node(instance in=w156) -> ("Slot name"=w157, "Measurements"=w158)
        $"Read Slot Name" <- w157
        $"Table/Measurment" <- w158
        call "Enqueue Message (Single).gvi"(message queue in=w130, message="Deleting all memory", Buttons WebVI="Update Display")
      }
      frame "Load Selection" {
        call "Enqueue Message (Single).gvi"(message queue in=w130, message="Load selection", Buttons WebVI="Update Display")
      }
      frame "Set Load" { }
      frame "Calculations/Read Slot Memory" {
        w159 = "Read"  # Command
        call "Memory buffer.gvi"(Number of slot=$"Slot number Tab 1", Command to buffer=w159) -> (Read/Slot=w160)
        Property Node(instance in=w160) -> ("Slot name"=w161, "Measurements"=w162)
        $"Slot name" <- w161
        $"Table Measurments" <- w162
        call "Enqueue Message (Single).gvi"(message queue in=w130, message="Buffer memory-Tab1", Buttons WebVI="Update Display")
      }
      frame "Calculation/Tab 1" {
        w163 = "Read"  # Command
        call "Memory buffer.gvi"(Number of slot=$"Slot number Tab 1", Command to buffer=w163) -> (Read/Slot=w164)
        Property Node(instance in=w164) -> ("Measurements"=w165)
        Array Index(array=w165) -> (out0[_, 0]=w166, out1[_, 1]=w167, out2[_, 4]=w168)
        Build Index And Bundle Cluster Array(w166, w167) -> (out=w169)
        Multiply(w166, w167) -> w170
        Build Index And Bundle Cluster Array(w166, w170) -> (out=w171)
        Build Cluster Array(w169, w171) -> (out=w172)
        $"Graph Tab 1" <- w172
        w173 = "Write"  # Command
        w174 = "Read"  # Command
        call "Memory buffer.gvi"(Number of slot=$"Slot number Tab 1", Command to buffer=w174) -> (Read/Slot=w175)
        w176 = 0.025  # Square Solar Panel
        Multiply(w168, w176) -> w177
        Divide(x=w170, y=w177) -> w178
        Multiply(w178, 100) -> w179
        Build Array(w170, w179) -> w180
        Transpose 2D Array(2D array=w180) -> (transposed array=w181)
        Property Node(instance in=w175, "Calculations "=w181) -> (instance out=w182)
        call "Memory buffer.gvi"(Buffer Data=w182, Number of slot=$"Slot number Tab 1", Command to buffer=w173) -> (Read/Slot=w183)
        call "Memory buffer.gvi"(Buffer Data=w183, Number of slot=$"Slot number Tab 1", Command to buffer="Read") -> (Read/Slot=w184)
        Property Node(instance in=w184) -> ("Measurements"=w185, "Calculations "=w186)
        Insert Into Array(inArray=w185, index1=6, new=w186) -> w187
        $"Table Measurments" <- w187
        call "Enqueue Message (Single).gvi"(message queue in=w130, message="Calculate Tab 1", Buttons WebVI="Update Display")
      }
      frame "Clear/Tab 1" {
        Property Node(instance in=reference to "Graph Tab 1", "Value"=T1[] [])
        Property Node(instance in=reference to "Table Measurments", "Value"=f64[][] [])
        call "Enqueue Message (Single).gvi"(message queue in=w130, message="Clear Graph Tab 1", Buttons WebVI="Update Display")
      }
      frame "Calculation/Tab 2" {
        Build Array($"Calc/Slot number2.1", $"Calc/Slot number2.2", $"Calc/Slot number2.3", $"Calc/Slot number2.4") -> w188
        Build Array($"Show / Hide Graph 1", $"Show / Hide Graph 2", $"Show / Hide Graph 3", $"Show / Hide Graph 4") -> w189
        for {
          w190 = each element of w189
          w191 = each element of w188
          case (w190) {
            frame False, Default {
              w198 = cluster{"Element 1": f64[], "Element 2": f64[]} {all zero or empty}
              w195 = default
              w196 = T1[] []
              w197 = w198
            }
            frame True {
              w199 = "Read"  # Command
              call "Memory buffer.gvi"(Number of slot=w191, Command to buffer=w199) -> (Read/Slot=w200)
              Property Node(instance in=w200) -> (instance out=w201)
              Property Node(instance in=w201) -> ("Measurements"=w202, "Calculations "=w203, "Slot name"=w195)
              Array Index(array=w202) -> (out0[_, 0]=w204, out1[_, 1]=w205, out2[_, 2]=w206)
              Build Index And Bundle Cluster Array(w204, w205) -> (out=w207)
              Array Index(array=w203) -> (out0[_, 0]=w208, out1[_, 1]=w209)
              Build Index And Bundle Cluster Array(w204, w208) -> (out=w210)
              Build Cluster Array(w207, w210) -> (out=w196)
              Build Cluster(w206, w209) -> w197
            }
          }
          append w195 to w192
          concatenate w196 onto w193
          append w197 to w194
        }
        $"Graph 1 Tab 3" <- w193
        Array Index(array=w192) -> (out0[_]=w211, out1[_]=w212, out2[_]=w213, out3[_]=w214)
        $"Slot name2.1" <- w211
        $"Slot name2.2" <- w212
        $"Slot name2.3" <- w213
        $"Slot name2.4" <- w214
        $"Graph 2 Tab 3" <- w194
        call "Enqueue Message (Single).gvi"(message queue in=w130, message="Calculation Tab 2", Buttons WebVI="Update Display")
      }
      frame "Header Tab 3" {
        Property Node(instance in=reference to "Parameter X") -> ("Items"=w215, "Value"=w216)
        Array Index(array=w215) -> (out0[w216]=w217)
        Property Node(instance in=reference to "Parameter Y") -> ("Items"=w218, "Value"=w219)
        Array Index(array=w218) -> (out0[w219]=w220)
        Build Array(w217, w220) -> w221
        $"Header XY" <- w221
      }
      frame "Create Table/Tab 3" {
        w222 = "Write/Read "  # Command Chart
        call "Custom Chart.gvi"(Command Graph=w222, X=$X, Y=$Y) -> (Table out=w223)
        $"Table Tab 4" <- w223
        call "Enqueue Message (Single).gvi"(message queue in=w130, message="Crate Table Tab 3", Buttons WebVI="Update Display")
      }
      frame "Clear Table/Tab 3" {
        w224 = "Clear Table"  # Command Chart
        call "Custom Chart.gvi"(Command Graph=w224, X=$X, Y=$Y) -> (Table out=w225)
        $"Table Tab 4_2" <- w225
      }
      frame "Delete Last Table/Tab 3" {
        w226 = "Delete last"  # Command Chart
        call "Custom Chart.gvi"(Command Graph=w226, X=$X, Y=$Y) -> (Table out=w227)
        $"Table Tab 4" <- w227
      }
      frame "Show Chart" {
        call "Custom Chart.gvi"(Command Graph="Graph", X=$X, Y=$Y) -> (Chart=w228)
        $"Graph Tab 4" <- w228
      }
      frame "Clear Chart" {
        w229 = "Clear Chart"  # Command Chart
        call "Custom Chart.gvi"(Command Graph=w229, X=$X, Y=$Y) -> (Chart=w230)
        $"Graph Tab 4" <- w230
      }
      frame "Update Display" {
        $"Update Display" <- w131
      }
    }
    stop if FALSE
  }
