vi "Memory buffer.gvi"   [LabVIEW NXG 4.0.0]
inputs:
  "Command to buffer": "Command.gtype" = "Clear all"
  "Initialize/Max Number of slots memory": i32
  "Number of slot": i32
  "Buffer Data": "Buffer data.gtype"
  "Error in": error
outputs:
  "Slot name indicator": string[]
  "Read/Slot": "Buffer data.gtype"
  "Error out": error
  "Save all": string[][]
types:
  "Command.gtype" = enum{"Initialize", "Write", "Read", "Clear", "Clear all", "Save all"}
  "Buffer data.gtype" = cluster{"Slot name": string, "Measurements": f64[][], "Calculations ": f64[][]}
diagram:
  s1 = uninitialised  # shift register
  s2 = uninitialised  # shift register
  while {
    # s1: Buffer
    # s2: Max Number
    case ($"Command to buffer") {
      frame "Initialize", Default {
        Initialize Array(element="Buffer data.gtype" {all zero or empty}, size=$"Initialize/Max Number of slots memory") -> w1
        w2 = $"Initialize/Max Number of slots memory"
        w3 = default
        w4 = default
      }
      frame "Write" {
        Replace Array Subset(inArray=s1, index=$"Number of slot", new=$"Buffer Data") -> w1
        w2 = s2
        w3 = $"Buffer Data"
        w4 = default
      }
      frame "Read" {
        Array Index(array=s1) -> (out0[$"Number of slot"]=w3)
        w1 = s1
        w2 = s2
        w4 = default
      }
      frame "Clear" {
        Replace Array Subset(inArray=s1, index=$"Number of slot", new="Buffer data.gtype" {all zero or empty}) -> w1
        w2 = s2
        w3 = default
        w4 = default
      }
      frame "Clear all" {
        Initialize Array(element="Buffer data.gtype" {all zero or empty}, size=s2) -> w1
        w2 = s2
        w3 = default
        w4 = default
      }
      frame "Save all" {
        for (iteration -> i1) {
          w5 = each element of s1
          Property Node(instance in=w5) -> ("Slot name"=w6, "Measurements"=w7)
          for {
            w8 = each element of w7
            Number To Fractional String(number=w8) -> (F-format string=w10)
            append w10 to w9
          }
          Build Array(w6) -> w11
          Number To Decimal String(number=i1) -> (decimal integer string=w12)
          Concatenate Strings("Slot", w12) -> w13
          Build Array(w13) -> w14
          Build Array(w14, w11, w9) -> w15
          concatenate w15 onto w4
        }
        w1 = s1
        w2 = s2
        w3 = default
      }
    }
    for {
      w16 = each element of w1
      Property Node(instance in=w16) -> ("Slot name"=w18)
      Build Array(w18) -> w19
      concatenate w19 onto w17
    }
    next s1 = w1
    next s2 = w2
    stop if TRUE
  }
  $"Slot name indicator" <- w17
  $"Save all" <- w4
  $"Read/Slot" <- w3
  $"Error out" <- $"Error in"
