vi "Dequeue Message SLC.gvi"   [LabVIEW NXG 5.0.0]
inputs:
  "error in": error
  "message queue in": Queue<"Message Cluster SLC.gtype">
outputs:
  "error out": error
  "Message": string
  "Message Data": variant
  "Buttons SLC": "Buttons SLC.gtype"
  "message queue out": Queue<"Message Cluster SLC.gtype">
types:
  "Buttons SLC.gtype" = enum{"Initialize", "Connecting Solar Panel", "Cooling Conditions", "Heating Conditions", "Dimming conditions", "Tilt angle", "Power setting", "Load ", "Set Load", "Set"}
  "Message Cluster SLC.gtype" = cluster{"Message": string, "Message Data": variant, "Buttons SLC": "Buttons SLC.gtype"}
diagram:
  $"message queue out" <- $"message queue in"
  Dequeue Element(queue=$"message queue in") -> (element=w1, error out=w2)
  Property Node(instance in=w1) -> ("Message"=w3, "Message Data"=w4, "Buttons SLC"=w5)
  $Message <- w3
  $"Message Data" <- w4
  $"Buttons SLC" <- w5
  Merge Errors($"error in", w2) -> (error out=w6)
  $"error out" <- w6
