vi "Dequeue Message.gvi"   [LabVIEW NXG 5.0.0]
# This VI pulls messages off the Message Queue.
inputs:
  "message queue in": Queue<"Message Cluster.gtype">, required
  "error in": error
outputs:
  "message queue out": Queue<"Message Cluster.gtype">
  "Buttons WebVI": "Buttons WebVI.gtype"
  "message": string
  "message data": variant
  "error out": error
types:
  "Buttons WebVI.gtype" = enum{"Initialize ", "Measurements/Save in Memory Buffer", "Measurements/Read from Memory Buffer", "Memory Buffer/Clear", "Memory Buffer/Clear all", "Load Selection", "Set Load", "Calculations/Read Slot Memory", "Calculation/Tab 2", "Calculation/Tab 1", "Clear/Tab 1", "Update Display", "Create Table/Tab 3", "Show Chart", "Clear Table/Tab 3", "Delete Last Table/Tab 3", "Clear Chart", "Header Tab 3"}
  "Message Cluster.gtype" = cluster{"Message": string, "Message Data": variant, "Buttons WebVI": "Buttons WebVI.gtype"}
diagram:
  Dequeue Element(queue=$"message queue in") -> (element=w1, error out=w2, queue out=w3)
  $"message queue out" <- w3
  Property Node(instance in=w1) -> ("Message"=w4, "Message Data"=w5, "Buttons WebVI"=w6)
  $message <- w4
  $"message data" <- w5
  $"Buttons WebVI" <- w6
  Merge Errors($"error in", w2) -> (error out=w7)
  $"error out" <- w7
